# Grasshopper definition grasshopper_superball_clean_up.gh (Grasshopper 1.0.8)
# plug-ins: Karamba3D, Pufferfish, Anemone

crosec = CrossSectionKaramba3D(FamilyNameOfCrossSection="DefaultCroSec", Diameter_cm=<missing>, WallThickness_cm=0.4, mode="Circular Hollow")
crosec_2 = CrossSectionKaramba3D(FamilyNameOfCrossSection="DefaultCroSec", Diameter_cm=<missing>, WallThickness_cm=0.4, mode="Circular Hollow")
supp = SupportKaramba3D(PosInd=[<missing>, <missing>, <missing>], menu=[buttons(on, on, on, on, on, on)])
loads = LoadsKaramba3D(Vector=Vector(0, 0, -1), LCase="LC0", mode="Gravity")
supp_2 = SupportKaramba3D(PosInd=[<missing>, <missing>, <missing>], menu=[buttons(on, on, on, on, on, on)])
loads_2 = LoadsKaramba3D(Vector=Vector(0, 0, -1), LCase="LC0", mode="Gravity")
surfelem = CreateSurfaceElementKaramba3D(Mesh=<missing>, LimitDistance_m=0.005, Bending=True, mode="MeshToShell")  # -> Element, Points, Info
surfelem_2 = CreateSurfaceElementKaramba3D(Mesh=<missing>, LimitDistance_m=0.005, Bending=True, mode="MeshToShell")  # -> Element, Points, Info
lineelem = CreateLinearElementKaramba3D(
    Line=<missing>,
    CrossSection=crosec,
    LimitDistance_m=0.005,
    BucklingLengthY_m=-1,
    BucklingLengthZ_m=-1,
    BucklingLengthLT_m=-1,
    Bending=True,
    ToPolylineMaxAngle=0.03,
    ToPolylineTolerance=0.01,
    ToPolylineMaxEdgeLength=0.25,
    New=True,
    Remove=True,
    mode="LineToBeam")  # -> Element, Points, Info
lineelem_2 = CreateLinearElementKaramba3D(
    Line=<missing>,
    CrossSection=crosec_2,
    LimitDistance_m=0.005,
    BucklingLengthY_m=-1,
    BucklingLengthZ_m=-1,
    BucklingLengthLT_m=-1,
    Bending=True,
    ToPolylineMaxAngle=0.03,
    ToPolylineTolerance=0.01,
    ToPolylineMaxEdgeLength=0.25,
    New=True,
    Remove=True,
    mode="LineToBeam")  # -> Element, Points, Info
assemble = AssembleModelKaramba3D(Elem=flatten([lineelem.Element, surfelem.Element]), Support=flatten(supp), Load=flatten(loads), LimitDistance_m=0.005)  # -> Model, Info, Mass_kg, CentreOfGravity, LoadCaseNames
assemble_2 = AssembleModelKaramba3D(
    Elem=flatten([lineelem_2.Element, surfelem_2.Element]),
    Support=flatten(supp_2),
    Load=flatten(loads_2),
    LimitDistance_m=0.005)  # -> Model, Info, Mass_kg, CentreOfGravity, LoadCaseNames
analyse = AnalyseKaramba3D(Model=assemble.Model)  # -> AnalysedModel, MaximumDisplacement_cm, ResultingForce_kN, ChangeOfElasticEnergy_kNm
analyse_2 = AnalyseKaramba3D(Model=assemble_2.Model)  # -> AnalysedModel, MaximumDisplacement_cm, ResultingForce_kN, ChangeOfElasticEnergy_kNm
modelview = ModelViewKaramba3D(Model=analyse.AnalysedModel, Colours=<missing>)  # -> Model, DeformedMesh, DeformedAxes, DeformedModel, MaximumDeformation
modelview_2 = ModelViewKaramba3D(Model=analyse_2.AnalysedModel, Colours=<missing>)  # -> Model, DeformedMesh, DeformedAxes, DeformedModel, MaximumDeformation
beamview = BeamViewKaramba3D(Model=modelview.Model)  # -> Model, MeshesOfRenderedBeams, DeformedBeamAxes, LegendColours, LegendTags
shellview = ShellViewKaramba3D(Model=modelview.Model, IndexOfLayer=0)  # -> Model, MeshesOfRenderedShells, LegendColours, LegendTags
beamview_2 = BeamViewKaramba3D(Model=modelview_2.Model)  # -> Model, MeshesOfRenderedBeams, DeformedBeamAxes, LegendColours, LegendTags
shellview_2 = ShellViewKaramba3D(Model=modelview_2.Model, IndexOfLayer=0)  # -> Model, MeshesOfRenderedShells, LegendColours, LegendTags
panel = Panel("rotation comparison")
panel_2 = Panel("struts")
panel_3 = Panel("surface")
panel_4 = Panel("wire")
panel_5 = Panel("10 struts design")
geo = Geometry([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])
geo_2 = Geometry([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])
panel_6 = Panel("6 struts triangle design")
geo_3 = Geometry([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])
geo_4 = Geometry([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])
geo_5 = Geometry([Line((52.81789703, -1.448079771, 31.7788585), (56.56789703, 7.723280664, 24.77257135)), Line((56.56789835, 5.047111576, 31.77886421), (62.6355207, -2.78616056, 24.77256559)), Line((60.3178948, -1.448076688, 31.77886056), (50.50027303, -2.786153621, 24.77258596)), Line((50.50027115, 4.220134429, 27.44873359), (56.56788932, -3.613134818, 20.44244163)), Line((56.56788914, -6.289301761, 27.44873384), (60.31789508, 2.882052385, 20.44244163)), Line((62.63552506, 4.220132368, 27.44873516), (52.81789508, 2.882059844, 20.44245759))])
geo_6 = Geometry([Line((52.81789703, -1.448079771, 31.7788585), (56.56789835, 5.047111576, 31.77886421)), Line((52.81789703, -1.448079771, 31.7788585), (60.3178948, -1.448076688, 31.77886056)), Line((52.81789703, -1.448079771, 31.7788585), (50.50027115, 4.220134429, 27.44873359)), Line((52.81789703, -1.448079771, 31.7788585), (50.50027303, -2.786153621, 24.77258596)), Line((56.56789835, 5.047111576, 31.77886421), (60.3178948, -1.448076688, 31.77886056)), Line((56.56789835, 5.047111576, 31.77886421), (56.56789703, 7.723280664, 24.77257135))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])
geo_7 = Geometry([Line((58.59044015, 5.663508203, 28.00005691), (56.56789835, 5.047111576, 31.77886421)), Line((58.59044015, 5.663508203, 28.00005691), (56.56789703, 7.723280664, 24.77257135)), Line((58.59044015, 5.663508203, 28.00005691), (62.63552506, 4.220132368, 27.44873516)), Line((59.84043488, -3.507846337, 28.00005333), (60.3178948, -1.448076688, 31.77886056)), Line((59.84043488, -3.507846337, 28.00005333), (56.56788914, -6.289301761, 27.44873384)), Line((59.84043488, -3.507846337, 28.00005333), (62.6355207, -2.78616056, 24.77256559))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])
struts = Geometry(geo_5)
string = Geometry([geo_6, geo_7])
mesh = Mesh()  # disabled
entwine = Entwine(Branch00=struts, Branch01=string, Branch02=mesh, FlattenInputs=True)

# ---- group: scale model size
scale = Scale(Geometry=entwine, Center=Point(0, 0, 0), Factor=Slider(0.9, range=0..1))  # -> Geometry, Transform
geo_8 = Geometry(scale.Geometry)
len = Length(Curve=scale.Geometry)
panel_7 = Panel(len)

# ---- group: model dropping height
initial_z = Slider(5, range=0..100)
addition = Addition(A=initial_z, B=Slider(270, range=0..1000))
Z = UnitZ(Factor=addition)
move = Move(Geometry=scale.Geometry, Motion=Z)  # -> Geometry, Transform

# ----
pipe_radius = Slider(0.3, range=0..1)
branch = TreeBranch(Tree=move.Geometry, Path="0,0", MaintainPaths=True)
pipe = Pipe(Curve=branch, Radius=pipe_radius, Caps=0)
branch_2 = TreeBranch(Tree=move.Geometry, Path="0,2", MaintainPaths=True)
mesh_2 = Mesh(branch_2)

# ---- group: mesh tension
custom_mesh_settings = SettingsCustom(
    StitchSeams=True,
    SimplePlanes=False,
    Refine=True,
    MinCount="5",
    MaxCount="5",
    AspectRatio=20,
    MaxDistance=0,
    MaxAngle=20,
    MinEdge="5",
    MaxEdge=0)
msh2psrf = MeshToPolysurface(Mesh=mesh_2, Triangles=False, FaceMerge=False)
mesh_3 = MeshBrep(Brep=msh2psrf, Settings=custom_mesh_settings)
medges = MeshEdges(Mesh=mesh_3)  # -> NakedEdges, InteriorEdges, NonManifoldEdges
explode = Explode(Curve=[medges.NakedEdges, medges.InteriorEdges], Recursive=True)  # -> Segments, Vertices
explode_2 = Explode(Curve=[medges.NakedEdges, medges.InteriorEdges], Recursive=True)  # -> Segments, Vertices

# ----
branch_3 = TreeBranch(Tree=move.Geometry, Path="0,1", MaintainPaths=True)

# ---- group: gravity
number_slider = Slider(10, range=0..10)
Z_2 = UnitZ(Factor=number_slider)  # -> expr("-x", UnitVector)

# ---- group: midpoint of model
connect = ConnectCurves(Curves=branch_3, Continuity=0, Close=True, Bulge=1)
bbox = BoundingBox(Content=connect, Plane=PlaneXY(0, 0, 0))  # -> Box, Box_2
volume = Volume(Geometry=bbox.Box)  # -> Volume, Centroid

# ----
panel_8 = Panel(branch_3)
strut_weight_kg_m = Slider(0.2, range=0..5)

# ---- group: struts weight
len_2 = Length(Curve=branch)
ma = MassAddition(Input=len_2)  # -> Result, PartialResults
division = Division(A=ma.Result, B=Slider(10, range=0..10))
multiplication = Multiplication(A=division, B=strut_weight_kg_m)

# ----
payload_weight = Slider(2, range=0..10)
panel_9 = Panel(multiplication)

# ---- group: strut and wire property
number_slider_2 = Slider(100000, range=0..100000)
length_line = LengthLine(Line=branch, Strength=Slider(1000000, range=0..1000000))
length_line_2 = LengthLine(Line=flatten(explode_2.Segments), Length=flatten(explode_2.Segments), Strength=number_slider_2)  # disabled
length_line_3 = LengthLine(Line=branch_3, Strength=number_slider_2)

# ---- group: environment
floor = Floor(Strength=Slider(100000000, range=0..100000000))

# ----
show = Show(G=branch)
show_2 = Show(G=branch_3)
show_3 = Show(G=volume.Centroid)
toggle = BooleanToggle(False)

# ---- group: KE gravity
loop_index = Slider(200, range=0..1000)
initial_velocity = Slider(0, range=0..100)
scale_2 = Slider(60, range=0..1000)
division_2 = Division(A=number_slider, B=scale_2)
loop_start = LoopStart(Repeat=loop_index, Trigger=toggle, Data=initial_velocity)  # -> port, Counter, Data
addition_2 = Addition(A=loop_start.Data, B=division_2)
loop_end = LoopEnd(port=loop_start.port, Exit=False, Data=addition_2, TimeOutVal=0, pausedState=False, state="Constant output")
pow = Power(A=loop_end, B=Slider(2, range=0..10))
addition_3 = Addition(A=payload_weight, B=multiplication)
multiplication_2 = Multiplication(A=pow, B=Slider(-0.5, range=-0.5..0.5), C=addition_3)

# ---- group: air resistance
project = Project(Geometry=[pipe, mesh_2], Plane=PlaneXY(0, 0, 0))  # -> Geometry, Transform
air_density_kg_m3 = Slider(1.225, range=0..10)
number_slider_3 = Slider(0.5, range=0..1)
c_d = Slider(1, range=0.7..1.2)
area = Area(Geometry=project.Geometry)  # -> flatten(Area), Centroid
clean = CleanTree(RemoveNulls=True, RemoveInvalid=True, RemoveEmpty=False, Tree=area.Area)
ma_2 = MassAddition(Input=clean)  # -> Result, PartialResults
multiplication_3 = Multiplication(A=number_slider_3, B=air_density_kg_m3, C=c_d, D=pow, E=ma_2.Result)
division_3 = Division(A=multiplication_3, B=scale_2)

# ----
filter = StreamFilter(Gate=Toggle(True), Stream0=Slider(0, range=0..100), Stream1=division_3)
addition_4 = Addition(A=multiplication_2, B=filter)
panel_10 = Panel(addition_4)

# ---- group: force
dw = DynamicWeight1d(Line=branch, Weight=addition_4)
load = Load(Point=volume.Centroid, ForceVector=Z_2, Weighting=payload_weight)

# ----
merge = Merge(Data1=floor, Data2=length_line, Data3=length_line_3, Data4=length_line_2, Data5=dw, Data6=load)
entwine_2 = Entwine(Branch00=show, Branch01=show_2, Branch02=show_3, Branch03=merge, FlattenInputs=True)
lng = ListLength(List=[show, show_2])  # -> flatten(Length)
bouncysolver = BouncySolver(GoalObjects=graft(entwine_2), Reset=Button(), Threshold=1e-15, Tolerance=0.0001, Damping=0.99, Iterations=10, On=toggle)  # -> I, V, O
ma_3 = MassAddition(Input=lng)  # -> Result, PartialResults
split = SplitList(List=flatten(bouncysolver.O), Index=ma_3.Result)  # -> flatten(ListA), ListB
lng_2 = ListLength(List=show)
split_2 = SplitList(List=split.ListA, Index=lng_2)  # -> ListA, ListB

# ---- group: high point
item = ListItem(List=bouncysolver.V, Index=Slider(12, range=0..100), Wrap=True)

# ----
panel_11 = Panel(bouncysolver.O)

# ---- group: bottom point
item_2 = ListItem(List=bouncysolver.V, Index=Slider(0, range=0..100), Wrap=True)

# ---- group: mid point
connect_2 = ConnectCurves(Curves=split_2.ListB, Continuity=0, Close=True, Bulge=1)
bbox_2 = BoundingBox(Content=connect_2, Plane=PlaneXY(0, 0, 0))  # -> Box, Box_2
volume_2 = Volume(Geometry=bbox_2.Box)  # -> Volume, Centroid

# ----
py3 = Python3Script(x=item, y=item_2, z=volume_2.Centroid, u=Toggle(False), v=Toggle(False))  # -> out, a
# ---------- py3: Python ----------
"""Grasshopper Script Instance"""
import System
import Rhino
import Grasshopper

import rhinoscriptsyntax as rs
import Rhino.Geometry as rg
import scriptcontext as sc
import Rhino
import csv
import os

# Specify the path for the CSV file
file_path = os.path.join("/Users/julia/Desktop/Cornell2025Spring/studio/data", "positions.csv")

if v:
    open(file_path, 'w').close()
if u:
    a = 0
    sc.sticky["count"] = 0
    sc.sticky["flag"] = 1000

else:
    sc.sticky["count"] += 1

    if sc.sticky["count"] > 2:
        sc.sticky["count"] = 0
        # Find objects and get locations
        obj = sc.doc.Objects.Find(x)
        current_pos1 = obj.Geometry.Location if obj else rg.Point3d.Unset

        obj = sc.doc.Objects.Find(y)
        current_pos2 = obj.Geometry.Location if obj else rg.Point3d.Unset

        obj = sc.doc.Objects.Find(z)
        current_pos3 = obj.Geometry.Location if obj else rg.Point3d.Unset


        # Write positions to a CSV file
        with open(file_path, 'a', newline='') as file:
            writer = csv.writer(file)
            writer.writerow([current_pos1.X, current_pos1.Y, current_pos1.Z, current_pos2.X, current_pos2.Y, current_pos2.Z, current_pos3.X, current_pos3.Y, current_pos3.Z])

    # if current_pos3.Z < sc.sticky["flag"]:
        a = [current_pos1.X, current_pos1.Y, current_pos1.Z, current_pos2.X, current_pos2.Y, current_pos2.Z, current_pos3.X, current_pos3.Y, current_pos3.Z]
    #     sc.sticky["flag"] = current_pos3.Z

# a = sc.sticky["flag"]




    


        # writer.writerow(['X1', 'Y1', 'Z1', 'X2', 'Y2', 'Z2', 'X3', 'Y3', 'Z3', 'X1', 'Y1', 'Z1', 'X2', 'Y2', 'Z2', 'X3', 'Y3', 'Z3'])  # Column headers for clarity

        # # Zip lists and write rows
        # for pos1, pos2, pos3, pos11, pos22, pos33 in sc.sticky["positions"]:
        #     writer.writerow([pos1.X, pos1.Y, pos1.Z, pos2.X, pos2.Y, pos2.Z, pos3.X, pos3.Y, pos3.Z, pos11.X, pos11.Y, pos11.Z, pos22.X, pos22.Y, pos22.Z, pos33.X, pos33.Y, pos33.Z])
# ---------- end py3 ----------

# ---- group: payload
sph = Sphere(Base=volume_2.Centroid, Radius=Slider(1, range=0..10))

# ---- group: strut
pipe_2 = Pipe(Curve=split_2.ListA, Radius=Slider(0.3, range=0..1), Caps=0)

# ----
panel_12 = Panel(py3.a)
geo_9 = Geometry(split_2.ListB)
