# Grasshopper definition grasshopper_superball_karamba.gh (Grasshopper 1.0.8)
# plug-ins: Karamba3D, RhinoCodePluginGH, Anemone, Kangaroo2 Components

panel = Panel("regular superball")  # disabled
panel_2 = Panel("0.5 superball")  # disabled
panel_3 = Panel("0.75 superball")
string = Geometry([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])  # disabled
struts = Geometry([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])  # disabled
string_2 = Geometry([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])  # disabled
struts_2 = Geometry([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])  # disabled
string_3 = Geometry([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])
struts_3 = Geometry([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])
# regular superball (bad position)
geo = Geometry([<curve referenced from the Rhino model> x25])  # disabled
geo_2 = Geometry([<curve referenced from the Rhino model> x6])  # disabled
panel_4 = Panel("more tense superball")  # disabled
panel_5 = Panel("more tense 0.5 superball")  # disabled
panel_6 = Panel("more tense 0.75 superball")  # disabled
string_4 = Geometry([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])  # disabled
struts_4 = Geometry([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])  # disabled
geo_3 = Geometry([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])  # disabled
string_5 = Geometry([<curve referenced from the Rhino model> x25])  # disabled
struts_5 = Geometry([<curve referenced from the Rhino model> x6])  # disabled
geo_4 = Geometry([<curve referenced from the Rhino model> x28])  # disabled
string_6 = Geometry([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])  # disabled
struts_6 = Geometry([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])  # disabled
geo_5 = Geometry([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])  # disabled
# more tense superball
# (bad position)
geo_6 = Geometry()  # disabled
geo_7 = Geometry()  # disabled
geo_8 = Geometry()  # disabled
number_slider = Slider(31, range=0..100)  # disabled
scale = Slider(100, range=0..1000)  # disabled
number_slider_2 = Slider(100000, range=0..100000)  # disabled
initial_z = Slider(53, range=0..100)  # disabled
number_slider_3 = Slider(0.3, range=0..1)  # disabled
initial_velocity = Slider(0, range=0..100)  # disabled
gravity = Slider(9.8, range=0..10)  # disabled
weight = Slider(6, range=0..10)  # disabled
loop_index = Slider(85, range=0..1000)  # disabled
k = Slider(8000, range=0..10000)  # disabled
string_7 = Geometry()  # disabled
struts_7 = Geometry()  # disabled
geo_9 = Geometry()  # disabled
Y = UnitY(Factor=expr("-x", number_slider))  # disabled
len = Length(Curve=struts_7)  # disabled
_2 = Slider(2, range=0..10)  # disabled
number_slider_4 = Slider(3, range=0..10)  # disabled
scale_2 = Slider(100, range=0..1000)  # disabled
initial_z_2 = Slider(53, range=0..100)  # disabled
number_slider_5 = Slider(100000, range=0..100000)  # disabled
number_slider_6 = Slider(0.3, range=0..1)  # disabled
initial_velocity_2 = Slider(0, range=0..100)  # disabled
gravity_2 = Slider(9.8, range=0..10)  # disabled
weight_2 = Slider(3, range=0..10)  # disabled
loop_index_2 = Slider(85, range=0..1000)  # disabled
k_2 = Slider(8000, range=0..10000)  # disabled
number_slider_7 = Slider(0.5, range=0..1)  # disabled
air_density_kg_m3 = Slider(1.225, range=0..10)  # disabled
c_d = Slider(1, range=0.7..1.2)  # disabled
string_8 = Geometry(string_3)  # disabled
struts_8 = Geometry(struts_3)  # disabled
move = Move(Geometry=string, Motion=Y)  # -> Geometry, Transform; disabled
Z = UnitZ(Factor=initial_z)  # disabled
move_2 = Move(Geometry=struts, Motion=Y)  # -> Geometry, Transform; disabled
avr = Average(Input=len)  # disabled
move_3 = Move(Geometry=[string_7, geo_9], Motion=Z)  # -> Geometry, Transform; disabled
pi = Pi(Factor=1)  # disabled
len_2 = Length(Curve=struts_8)  # disabled
_2_2 = Slider(2, range=0..10)  # disabled
number_slider_8 = Slider(24, range=0..100)  # disabled
number_slider_9 = Slider(3, range=0..10)  # disabled
move_4 = Move(Geometry=struts_7, Motion=Z)  # -> Geometry, Transform; disabled
air_density_kg_m3_2 = Slider(1.225, range=0..10)  # disabled
number_slider_10 = Slider(0.5, range=0..1)  # disabled
c_d_2 = Slider(1, range=0.7..1.2)  # disabled
multiplication = Multiplication(A=_2, B=pi, C=number_slider_3, D=avr, E=number_slider_4)  # disabled
scale_3 = Slider(100, range=0..1000)  # disabled
number_slider_11 = Slider(100000, range=0..100000)  # disabled
initial_z_3 = Slider(53, range=0..100)  # disabled
Z_2 = UnitZ(Factor=initial_z_2)  # disabled
number_slider_12 = Slider(0.3, range=0..1)  # disabled
initial_velocity_3 = Slider(0, range=0..100)  # disabled
gravity_3 = Slider(9.8, range=0..10)  # disabled
weight_3 = Slider(3, range=0..10)  # disabled
loop_index_3 = Slider(85, range=0..1000)  # disabled
k_3 = Slider(8000, range=0..10000)  # disabled
string_9 = Geometry(move.Geometry)  # disabled
struts_9 = Geometry(move_2.Geometry)  # disabled
avr_2 = Average(Input=len_2)  # disabled
move_5 = Move(Geometry=string_8, Motion=Z_2)  # -> Geometry, Transform; disabled
loop_index_4 = Slider(196, range=0..1000)  # disabled
pi_2 = Pi(Factor=1)  # disabled
number_slider_13 = Slider(3, range=0..10)  # disabled
initial_speed = Slider(0, range=0..100)  # disabled
scale_4 = Slider(100000, range=0..100000)  # disabled
gravity_4 = Slider(9.8, range=0..10)  # disabled
division = Division(A=gravity, B=scale)  # disabled
start_height = Slider(100, range=0..100)  # disabled
number_slider_14 = Slider(100000, range=0..100000)  # disabled
move_6 = Move(Geometry=struts_8, Motion=Z_2)  # -> Geometry, Transform; disabled
number_slider_15 = Slider(3, range=0..10)  # disabled
multiplication_2 = Multiplication(A=_2_2, B=pi_2, C=number_slider_6, D=avr_2, E=number_slider_9)  # disabled
len_3 = Length(Curve=struts_9)  # disabled
_2_3 = Slider(2, range=0..10)  # disabled
number_slider_16 = Slider(3, range=0..10)  # disabled
number_slider_17 = Slider(0.5, range=0..1)  # disabled
air_density_kg_m3_3 = Slider(1.225, range=0..10)  # disabled
c_d_3 = Slider(1, range=0.7..1.2)  # disabled
split = SplitList(List=move_3.Geometry, Index=number_slider_8)  # -> ListA, ListB; disabled
len_4 = Length(Curve=move_5.Geometry)  # disabled
number_slider_18 = Slider(0.8, range=0..10)  # disabled
panel_7 = Panel(move_5.Geometry)  # disabled
number_slider_19 = Slider(2, range=0..10)  # disabled
number_slider_20 = Slider(-0.5, range=-0.5..0.5)  # disabled
Z_3 = UnitZ(Factor=initial_z_3)  # disabled
avr_3 = Average(Input=len_3)  # disabled
move_7 = Move(Geometry=string_9, Motion=Z_3)  # -> Geometry, Transform; disabled
pi_3 = Pi(Factor=1)  # disabled
division_2 = Division(A=gravity_2, B=scale_2)  # disabled
division_3 = Division(A=gravity_4, B=scale_4)  # disabled
number_slider_21 = Slider(100000, range=0..100000)  # disabled
number_slider_22 = Slider(0.1, range=0..0.1)  # disabled
geo_10 = Geometry(split.ListB)  # disabled
avr_4 = Average(Input=len_4)  # disabled
move_8 = Move(Geometry=struts_9, Motion=Z_3)  # -> Geometry, Transform; disabled
pt = ConstructPoint(XCoordinate=0, YCoordinate=0, ZCoordinate=start_height)  # disabled
number_slider_23 = Slider(0.3, range=0.1..0.5)  # disabled
number_slider_24 = Slider(1.225, range=0..10)  # disabled
number_slider_25 = Slider(0.5, range=0..1)  # disabled
multiplication_3 = Multiplication(A=_2_3, B=pi_3, C=number_slider_12, D=avr_3, E=number_slider_16)  # disabled
floor = Floor(Strength=number_slider_14)  # disabled
number_slider_26 = Slider(2, range=0..10)  # disabled
number_slider_27 = Slider(-0.5, range=-0.5..0.5)  # disabled
pl = PlasticLength(Line=move_3.Geometry, Limit=1, Strength=k)  # disabled
ct = ConstantTension(Line=move_3.Geometry, Strength=k)  # disabled
len_5 = Length(Curve=move_7.Geometry)  # disabled
number_slider_28 = Slider(0.8, range=0..10)  # disabled
panel_8 = Panel(move_7.Geometry)  # disabled
button = Button()  # disabled
srf = Surface(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)  # disabled
toggle = BooleanToggle(False)  # disabled
loop_start = LoopStart(Repeat=loop_index_2, Trigger=toggle, Data=initial_velocity_2)  # -> port, Counter, Data; disabled
addition = Addition(A=loop_start.Data, B=division_2)  # disabled
loop_end = LoopEnd(port=loop_start.port, Exit=False, Data=addition, TimeOutVal=0, pausedState=False, state="Constant output")  # disabled
multiplication_4 = Multiplication(A=avr_4, B=number_slider_18)  # disabled
loop_start_2 = LoopStart(Repeat=loop_index_3, Trigger=toggle, Data=initial_velocity_3)  # -> port, Counter, Data; disabled
division_4 = Division(A=gravity_3, B=scale_3)  # disabled
sph = Sphere(Base=pt, Radius=number_slider_15)  # disabled
number_slider_29 = Slider(100000, range=0..100000)  # disabled
solidplanecollide = SolidPlaneCollide(Solid=sph, CollisionPlane=srf, Strength=number_slider_22)  # disabled
button_2 = Button()  # disabled
avr_5 = Average(Input=len_5)  # disabled
toggle_2 = BooleanToggle(False)  # disabled
loop_start_3 = LoopStart(Repeat=loop_index_4, Trigger=toggle_2, Data=initial_speed)  # -> port, Counter, Data; disabled
addition_2 = Addition(A=loop_start_3.Data, B=division_3)  # disabled
floor_2 = Floor(Strength=number_slider_21)  # disabled
addition_3 = Addition(A=loop_start_2.Data, B=division_4)  # disabled
number_slider_30 = Slider(1000000, range=0..1000000)  # disabled
pl_2 = PlasticLength(Line=move_5.Geometry, Limit=1, Strength=k_2)  # disabled
pow = Power(A=loop_end, B=number_slider_26)  # disabled
multiplication_5 = Multiplication(A=number_slider_10, B=air_density_kg_m3_2, C=c_d_2, D=pow, E=multiplication_2)  # disabled
division_5 = Division(A=multiplication_5, B=scale_2)  # disabled
loop_end_2 = LoopEnd(port=loop_start_3.port, Exit=False, Data=addition_2, TimeOutVal=0, pausedState=False, state="Constant output")  # disabled
ct_2 = ConstantTension(Line=move_5.Geometry, Strength=k_2)  # disabled
panel_9 = Panel(multiplication_4)  # disabled
number_slider_31 = Slider(2, range=0..10)  # disabled
area = Area(Geometry=sph)  # -> Area, Centroid; disabled
panel_10 = Panel(addition_2)  # disabled
number_slider_32 = Slider(-0.5, range=-0.5..0.5)  # disabled
multiplication_6 = Multiplication(A=number_slider_23, B=loop_end_2)  # disabled
multiplication_7 = Multiplication(A=area.Area, B=loop_end_2)  # disabled
multiplication_8 = Multiplication(A=number_slider_25, B=number_slider_24)  # disabled
loop_end_3 = LoopEnd(port=loop_start_2.port, Exit=False, Data=addition_3, TimeOutVal=0, pausedState=False, state="Constant output")  # disabled
multiplication_9 = Multiplication(A=avr_5, B=number_slider_28)  # disabled
multiplication_10 = Multiplication(A=pow, B=weight_2, C=number_slider_27)  # disabled
Z_4 = UnitZ(Factor=expr("-x", loop_end_2))  # disabled
multiplication_11 = Multiplication(A=multiplication_8, B=multiplication_6, C=multiplication_7)  # disabled
floor_3 = Floor(Strength=number_slider_29)  # disabled
length_line = LengthLine(Line=move_4.Geometry, Strength=number_slider_2)  # disabled
Z_5 = UnitZ(Factor=multiplication_11)  # disabled
floor_4 = Floor(Strength=number_slider_30)  # disabled
addition_4 = Addition(A=multiplication_10, B=division_5)  # disabled
pl_3 = PlasticLength(Line=move_7.Geometry, Limit=1, Strength=k_3)  # disabled
pow_2 = Power(A=loop_end_3, B=number_slider_31)  # disabled
multiplication_12 = Multiplication(A=number_slider_17, B=air_density_kg_m3_3, C=c_d_3, D=pow_2, E=multiplication_3)  # disabled
division_6 = Division(A=multiplication_12, B=scale_3)  # disabled
ct_3 = ConstantTension(Line=move_7.Geometry, Strength=k_3)  # disabled
panel_11 = Panel(multiplication_9)  # disabled
load = Load(Point=area.Centroid, ForceVector=Z_4, Weighting=number_slider_13)  # disabled
button_3 = Button()  # disabled
load_2 = Load(Point=area.Centroid, ForceVector=Z_5, Weighting=number_slider_13)  # disabled
dw = DynamicWeight1d(Line=move_6.Geometry, Weight=addition_4)  # disabled
toggle_3 = BooleanToggle(False)  # disabled
panel_12 = Panel(ct)  # disabled
multiplication_13 = Multiplication(A=pow_2, B=weight_3, C=number_slider_32)  # disabled
rigidbody = RigidBody(Part=sph, Strength=10)  # -> RigidBody, Planes; disabled
length_line_2 = LengthLine(Line=move_6.Geometry, Strength=number_slider_5)  # disabled
addition_5 = Addition(A=multiplication_13, B=division_6)  # disabled
panel_13 = Panel(ct_2)  # disabled
bouncysolver = BouncySolver(
    GoalObjects=[rigidbody.RigidBody, load, floor_4, solidplanecollide, load_2],
    Reset=button_2,
    Threshold=1e-15,
    Tolerance=0.0001,
    Damping=0.99,
    Iterations=10,
    On=toggle_2)  # -> I, V, O; disabled
number_slider_33 = Slider(0, range=0..100)  # disabled
number_slider_34 = Slider(1, range=0..100)  # disabled
number_slider_35 = Slider(2, range=0..100)  # disabled
number_slider_36 = Slider(3, range=0..100)  # disabled
number_slider_37 = Slider(4, range=0..100)  # disabled
number_slider_38 = Slider(5, range=0..100)  # disabled
number_slider_39 = Slider(6, range=0..100)  # disabled
number_slider_40 = Slider(7, range=0..100)  # disabled
button_4 = Button()  # disabled
number_slider_41 = Slider(8, range=0..100)  # disabled
number_slider_42 = Slider(9, range=0..100)  # disabled
dw_2 = DynamicWeight1d(Line=move_8.Geometry, Weight=addition_5)  # disabled
number_slider_43 = Slider(10, range=0..100)  # disabled
number_slider_44 = Slider(11, range=0..100)  # disabled
toggle_4 = BooleanToggle(False)  # disabled
multiplication_14 = Multiplication(A=division_3, B=number_slider_13)  # disabled
number_slider_45 = Slider(12, range=0..100)  # disabled
number_slider_46 = Slider(13, range=0..100)  # disabled
number_slider_47 = Slider(14, range=0..100)  # disabled
number_slider_48 = Slider(15, range=0..100)  # disabled
number_slider_49 = Slider(16, range=0..100)  # disabled
number_slider_50 = Slider(17, range=0..100)  # disabled
number_slider_51 = Slider(18, range=0..100)  # disabled
number_slider_52 = Slider(19, range=0..100)  # disabled
bouncysolver_2 = BouncySolver(
    GoalObjects=[pl_2, dw, floor_2, length_line_2, ct_2],
    Reset=button,
    Threshold=1e-15,
    Tolerance=0.0001,
    Damping=0.99,
    Iterations=10,
    On=toggle)  # -> I, V, O; disabled
length_line_3 = LengthLine(Line=move_8.Geometry, Strength=number_slider_11)  # disabled
panel_14 = Panel("Air resistance")  # disabled
panel_15 = Panel("Force / 10000")  # disabled
panel_16 = Panel(multiplication_11)  # disabled
panel_17 = Panel(multiplication_14)  # disabled
panel_18 = Panel(loop_end_2)  # disabled
panel_19 = Panel("velocity")  # disabled
toggle_5 = BooleanToggle(False)  # disabled
loop_start_4 = LoopStart(Repeat=loop_index, Trigger=toggle_5, Data=initial_velocity)  # -> port, Counter, Data; disabled
addition_6 = Addition(A=loop_start_4.Data, B=division)  # disabled
loop_end_4 = LoopEnd(port=loop_start_4.port, Exit=False, Data=addition_6, TimeOutVal=0, pausedState=False, state="Constant output")  # disabled
pow_3 = Power(A=loop_end_4, B=number_slider_19)  # disabled
multiplication_15 = Multiplication(A=number_slider_7, B=air_density_kg_m3, C=c_d, D=pow_3, E=multiplication)  # disabled
division_7 = Division(A=multiplication_15, B=scale)  # disabled
multiplication_16 = Multiplication(A=pow_3, B=weight, C=number_slider_20)  # disabled
addition_7 = Addition(A=multiplication_16, B=division_7)  # disabled
dw_3 = DynamicWeight1d(Line=move_4.Geometry, Weight=addition_7)  # disabled
button_5 = Button()  # disabled
bouncysolver_3 = BouncySolver(
    GoalObjects=[pl, ct, floor, dw_3, length_line],
    Reset=button_5,
    Threshold=1e-15,
    Tolerance=0.0001,
    Damping=0.99,
    Iterations=10,
    On=toggle_5)  # -> I, V, O; disabled
geo_11 = Geometry(bouncysolver_3.V)  # disabled
panel_20 = Panel(geo_11)  # disabled
number_slider_53 = Slider(0, range=0..100)  # disabled
number_slider_54 = Slider(1, range=0..100)  # disabled
number_slider_55 = Slider(2, range=0..100)  # disabled
number_slider_56 = Slider(3, range=0..100)  # disabled
number_slider_57 = Slider(4, range=0..100)  # disabled
number_slider_58 = Slider(5, range=0..100)  # disabled
number_slider_59 = Slider(6, range=0..100)  # disabled
number_slider_60 = Slider(7, range=0..100)  # disabled
number_slider_61 = Slider(8, range=0..100)  # disabled
number_slider_62 = Slider(9, range=0..100)  # disabled
number_slider_63 = Slider(10, range=0..100)  # disabled
number_slider_64 = Slider(11, range=0..100)  # disabled
item = ListItem(List=geo_11, Index=number_slider_33, Wrap=True)  # disabled
item_2 = ListItem(List=geo_11, Index=number_slider_34, Wrap=True)  # disabled
item_3 = ListItem(List=geo_11, Index=number_slider_35, Wrap=True)  # disabled
panel_21 = Panel(ct_3)  # disabled
item_4 = ListItem(List=geo_11, Index=number_slider_36, Wrap=True)  # disabled
item_5 = ListItem(List=geo_11, Index=number_slider_37, Wrap=True)  # disabled
item_6 = ListItem(List=geo_11, Index=number_slider_38, Wrap=True)  # disabled
item_7 = ListItem(List=geo_11, Index=number_slider_39, Wrap=True)  # disabled
item_8 = ListItem(List=geo_11, Index=number_slider_40, Wrap=True)  # disabled
item_9 = ListItem(List=geo_11, Index=number_slider_41, Wrap=True)  # disabled
item_10 = ListItem(List=geo_11, Index=number_slider_42, Wrap=True)  # disabled
item_11 = ListItem(List=geo_11, Index=number_slider_43, Wrap=True)  # disabled
item_12 = ListItem(List=geo_11, Index=number_slider_44, Wrap=True)  # disabled
geo_12 = Geometry(bouncysolver_2.V)  # disabled
panel_22 = Panel(geo_12)  # disabled
item_13 = ListItem(List=geo_11, Index=number_slider_45, Wrap=True)  # disabled
item_14 = ListItem(List=geo_11, Index=number_slider_46, Wrap=True)  # disabled
item_15 = ListItem(List=geo_11, Index=number_slider_47, Wrap=True)  # disabled
item_16 = ListItem(List=geo_11, Index=number_slider_48, Wrap=True)  # disabled
item_17 = ListItem(List=geo_11, Index=number_slider_49, Wrap=True)  # disabled
item_18 = ListItem(List=geo_11, Index=number_slider_50, Wrap=True)  # disabled
item_19 = ListItem(List=geo_11, Index=number_slider_51, Wrap=True)  # disabled
item_20 = ListItem(List=geo_11, Index=number_slider_52, Wrap=True)  # disabled
bbox = BoundingBox(Content=bouncysolver.V, Plane=PlaneXY(0, 0, 0))  # -> Box, Box_2; disabled
bouncysolver_4 = BouncySolver(
    GoalObjects=[pl_3, dw_2, floor_3, length_line_3, ct_3],
    Reset=button,
    Threshold=1e-15,
    Tolerance=0.0001,
    Damping=0.99,
    Iterations=10,
    On=toggle)  # -> I, V, O; disabled
geo_13 = Geometry(item)  # disabled
sph_2 = Sphere(Base=bouncysolver.V, Radius=number_slider_15)  # disabled
geo_14 = Geometry(item_2)  # disabled
geo_15 = Geometry(item_3)  # disabled
geo_16 = Geometry(item_4)  # disabled
geo_17 = Geometry(item_5)  # disabled
geo_18 = Geometry(item_6)  # disabled
geo_19 = Geometry(item_7)  # disabled
geo_20 = Geometry(item_8)  # disabled
geo_21 = Geometry(item_9)  # disabled
geo_22 = Geometry(item_10)  # disabled
geo_23 = Geometry(item_11)  # disabled
geo_24 = Geometry(item_12)  # disabled
geo_25 = Geometry(item_13)  # disabled
item_21 = ListItem(List=geo_12, Index=number_slider_53, Wrap=True)  # disabled
item_22 = ListItem(List=geo_12, Index=number_slider_54, Wrap=True)  # disabled
geo_26 = Geometry(item_14)  # disabled
item_23 = ListItem(List=geo_12, Index=number_slider_55, Wrap=True)  # disabled
item_24 = ListItem(List=geo_12, Index=number_slider_56, Wrap=True)  # disabled
geo_27 = Geometry(item_15)  # disabled
geo_28 = Geometry(item_16)  # disabled
item_25 = ListItem(List=geo_12, Index=number_slider_57, Wrap=True)  # disabled
geo_29 = Geometry(item_17)  # disabled
geo_30 = Geometry(item_18)  # disabled
item_26 = ListItem(List=geo_12, Index=number_slider_58, Wrap=True)  # disabled
geo_31 = Geometry(item_19)  # disabled
item_27 = ListItem(List=geo_12, Index=number_slider_59, Wrap=True)  # disabled
geo_32 = Geometry(item_20)  # disabled
item_28 = ListItem(List=geo_12, Index=number_slider_60, Wrap=True)  # disabled
item_29 = ListItem(List=geo_12, Index=number_slider_61, Wrap=True)  # disabled
item_30 = ListItem(List=geo_12, Index=number_slider_62, Wrap=True)  # disabled
item_31 = ListItem(List=geo_12, Index=number_slider_63, Wrap=True)  # disabled
item_32 = ListItem(List=geo_12, Index=number_slider_64, Wrap=True)  # disabled
number_slider_65 = Slider(0, range=0..100)  # disabled
number_slider_66 = Slider(1, range=0..100)  # disabled
number_slider_67 = Slider(2, range=0..100)  # disabled
number_slider_68 = Slider(3, range=0..100)  # disabled
number_slider_69 = Slider(4, range=0..100)  # disabled
number_slider_70 = Slider(5, range=0..100)  # disabled
number_slider_71 = Slider(6, range=0..100)  # disabled
number_slider_72 = Slider(7, range=0..100)  # disabled
number_slider_73 = Slider(8, range=0..100)  # disabled
number_slider_74 = Slider(9, range=0..100)  # disabled
number_slider_75 = Slider(10, range=0..100)  # disabled
number_slider_76 = Slider(11, range=0..100)  # disabled
geo_33 = Geometry(bouncysolver_4.V)  # disabled
panel_23 = Panel(geo_33)  # disabled
geo_34 = Geometry(sph_2)  # disabled
geo_35 = Geometry(item_21)  # disabled
geo_36 = Geometry(item_22)  # disabled
geo_37 = Geometry(item_23)  # disabled
geo_38 = Geometry(item_24)  # disabled
geo_39 = Geometry(item_25)  # disabled
geo_40 = Geometry(item_26)  # disabled
geo_41 = Geometry(item_27)  # disabled
geo_42 = Geometry(item_28)  # disabled
geo_43 = Geometry(item_29)  # disabled
geo_44 = Geometry(item_30)  # disabled
geo_45 = Geometry(item_31)  # disabled
geo_46 = Geometry(item_32)  # disabled
item_33 = ListItem(List=geo_33, Index=number_slider_65, Wrap=True)  # disabled
item_34 = ListItem(List=geo_33, Index=number_slider_66, Wrap=True)  # disabled
item_35 = ListItem(List=geo_33, Index=number_slider_67, Wrap=True)  # disabled
item_36 = ListItem(List=geo_33, Index=number_slider_68, Wrap=True)  # disabled
item_37 = ListItem(List=geo_33, Index=number_slider_69, Wrap=True)  # disabled
item_38 = ListItem(List=geo_33, Index=number_slider_70, Wrap=True)  # disabled
item_39 = ListItem(List=geo_33, Index=number_slider_71, Wrap=True)  # disabled
item_40 = ListItem(List=geo_33, Index=number_slider_72, Wrap=True)  # disabled
item_41 = ListItem(List=geo_33, Index=number_slider_73, Wrap=True)  # disabled
item_42 = ListItem(List=geo_33, Index=number_slider_74, Wrap=True)  # disabled
item_43 = ListItem(List=geo_33, Index=number_slider_75, Wrap=True)  # disabled
item_44 = ListItem(List=geo_33, Index=number_slider_76, Wrap=True)  # disabled
geo_47 = Geometry(item_33)  # disabled
geo_48 = Geometry(item_34)  # disabled
geo_49 = Geometry(item_35)  # disabled
geo_50 = Geometry(item_36)  # disabled
geo_51 = Geometry(item_37)  # disabled
geo_52 = Geometry(item_38)  # disabled
geo_53 = Geometry(item_39)  # disabled
geo_54 = Geometry(item_40)  # disabled
geo_55 = Geometry(item_41)  # disabled
geo_56 = Geometry(item_42)  # disabled
geo_57 = Geometry(item_43)  # disabled
geo_58 = Geometry(item_44)  # disabled
ln = Line(StartPoint=geo_25, EndPoint=geo_13)  # disabled
ln_2 = Line(StartPoint=geo_25, EndPoint=geo_15)  # disabled
ln_3 = Line(StartPoint=geo_25, EndPoint=geo_21)  # disabled
ln_4 = Line(StartPoint=geo_25, EndPoint=geo_26)  # disabled
ln_5 = Line(StartPoint=geo_26, EndPoint=geo_17)  # disabled
ln_6 = Line(StartPoint=geo_26, EndPoint=geo_20)  # disabled
ln_7 = Line(StartPoint=geo_26, EndPoint=geo_24)  # disabled
ln_8 = Line(StartPoint=geo_27, EndPoint=geo_15)  # disabled
ln_9 = Line(StartPoint=geo_27, EndPoint=geo_16)  # disabled
ln_10 = Line(StartPoint=geo_27, EndPoint=geo_22)  # disabled
ln_11 = Line(StartPoint=geo_27, EndPoint=geo_28)  # disabled
ln_12 = Line(StartPoint=geo_28, EndPoint=geo_17)  # disabled
ln_13 = Line(StartPoint=geo_28, EndPoint=geo_18)  # disabled
ln_14 = Line(StartPoint=geo_28, EndPoint=geo_23)  # disabled
ln_15 = Line(StartPoint=geo_29, EndPoint=geo_16)  # disabled
ln_16 = Line(StartPoint=geo_29, EndPoint=geo_14)  # disabled
ln_17 = Line(StartPoint=geo_29, EndPoint=geo_24)  # disabled
ln_18 = Line(StartPoint=geo_31, EndPoint=geo_32)  # disabled
ln_19 = Line(StartPoint=geo_32, EndPoint=geo_13)  # disabled
ln_20 = Line(StartPoint=geo_32, EndPoint=geo_14)  # disabled
ln_21 = Line(StartPoint=geo_29, EndPoint=geo_30)  # disabled
ln_22 = Line(StartPoint=geo_30, EndPoint=geo_18)  # disabled
ln_23 = Line(StartPoint=geo_30, EndPoint=geo_19)  # disabled
ln_24 = Line(StartPoint=geo_32, EndPoint=geo_23)  # disabled
ln_25 = Line(StartPoint=geo_30, EndPoint=geo_21)  # disabled
ln_26 = Line(StartPoint=geo_31, EndPoint=geo_19)  # disabled
ln_27 = Line(StartPoint=geo_31, EndPoint=geo_20)  # disabled
ln_28 = Line(StartPoint=geo_31, EndPoint=geo_22)  # disabled
ln_29 = Line(StartPoint=geo_35, EndPoint=geo_38)  # disabled
ln_30 = Line(StartPoint=geo_40, EndPoint=geo_42)  # disabled
ln_31 = Line(StartPoint=geo_36, EndPoint=geo_39)  # disabled
ln_32 = Line(StartPoint=geo_43, EndPoint=geo_45)  # disabled
ln_33 = Line(StartPoint=geo_37, EndPoint=geo_41)  # disabled
ln_34 = Line(StartPoint=geo_44, EndPoint=geo_46)  # disabled
ln_35 = Line(StartPoint=geo_35, EndPoint=geo_36)  # disabled
ln_36 = Line(StartPoint=geo_35, EndPoint=geo_37)  # disabled
ln_37 = Line(StartPoint=geo_36, EndPoint=geo_38)  # disabled
ln_38 = Line(StartPoint=geo_35, EndPoint=geo_45)  # disabled
ln_39 = Line(StartPoint=geo_39, EndPoint=geo_40)  # disabled
ln_40 = Line(StartPoint=geo_40, EndPoint=geo_41)  # disabled
ln_41 = Line(StartPoint=geo_38, EndPoint=geo_44)  # disabled
ln_42 = Line(StartPoint=geo_35, EndPoint=geo_43)  # disabled
ln_43 = Line(StartPoint=geo_41, EndPoint=geo_42)  # disabled
ln_44 = Line(StartPoint=geo_40, EndPoint=geo_43)  # disabled
ln_45 = Line(StartPoint=geo_41, EndPoint=geo_43)  # disabled
ln_46 = Line(StartPoint=geo_41, EndPoint=geo_44)  # disabled
ln_47 = Line(StartPoint=geo_36, EndPoint=geo_45)  # disabled
ln_48 = Line(StartPoint=geo_36, EndPoint=geo_46)  # disabled
ln_49 = Line(StartPoint=geo_37, EndPoint=geo_38)  # disabled
ln_50 = Line(StartPoint=geo_37, EndPoint=geo_44)  # disabled
ln_51 = Line(StartPoint=geo_38, EndPoint=geo_46)  # disabled
ln_52 = Line(StartPoint=geo_39, EndPoint=geo_42)  # disabled
ln_53 = Line(StartPoint=geo_37, EndPoint=geo_43)  # disabled
ln_54 = Line(StartPoint=geo_39, EndPoint=geo_45)  # disabled
ln_55 = Line(StartPoint=geo_39, EndPoint=geo_46)  # disabled
ln_56 = Line(StartPoint=geo_40, EndPoint=geo_45)  # disabled
ln_57 = Line(StartPoint=geo_42, EndPoint=geo_46)  # disabled
ln_58 = Line(StartPoint=geo_42, EndPoint=geo_44)  # disabled
ln_59 = Line(StartPoint=geo_47, EndPoint=geo_50)  # disabled
ln_60 = Line(StartPoint=geo_52, EndPoint=geo_54)  # disabled
ln_61 = Line(StartPoint=geo_48, EndPoint=geo_51)  # disabled
ln_62 = Line(StartPoint=geo_55, EndPoint=geo_57)  # disabled
ln_63 = Line(StartPoint=geo_49, EndPoint=geo_53)  # disabled
ln_64 = Line(StartPoint=geo_56, EndPoint=geo_58)  # disabled
ln_65 = Line(StartPoint=geo_47, EndPoint=geo_48)  # disabled
ln_66 = Line(StartPoint=geo_47, EndPoint=geo_49)  # disabled
ln_67 = Line(StartPoint=geo_48, EndPoint=geo_50)  # disabled
ln_68 = Line(StartPoint=geo_47, EndPoint=geo_57)  # disabled
ln_69 = Line(StartPoint=geo_51, EndPoint=geo_52)  # disabled
ln_70 = Line(StartPoint=geo_52, EndPoint=geo_53)  # disabled
ln_71 = Line(StartPoint=geo_50, EndPoint=geo_56)  # disabled
ln_72 = Line(StartPoint=geo_47, EndPoint=geo_55)  # disabled
ln_73 = Line(StartPoint=geo_53, EndPoint=geo_54)  # disabled
ln_74 = Line(StartPoint=geo_52, EndPoint=geo_55)  # disabled
ln_75 = Line(StartPoint=geo_53, EndPoint=geo_55)  # disabled
ln_76 = Line(StartPoint=geo_53, EndPoint=geo_56)  # disabled
ln_77 = Line(StartPoint=geo_48, EndPoint=geo_57)  # disabled
ln_78 = Line(StartPoint=geo_48, EndPoint=geo_58)  # disabled
ln_79 = Line(StartPoint=geo_49, EndPoint=geo_50)  # disabled
ln_80 = Line(StartPoint=geo_49, EndPoint=geo_56)  # disabled
ln_81 = Line(StartPoint=geo_50, EndPoint=geo_58)  # disabled
ln_82 = Line(StartPoint=geo_51, EndPoint=geo_54)  # disabled
ln_83 = Line(StartPoint=geo_49, EndPoint=geo_55)  # disabled
ln_84 = Line(StartPoint=geo_51, EndPoint=geo_57)  # disabled
ln_85 = Line(StartPoint=geo_51, EndPoint=geo_58)  # disabled
ln_86 = Line(StartPoint=geo_52, EndPoint=geo_57)  # disabled
ln_87 = Line(StartPoint=geo_54, EndPoint=geo_58)  # disabled
ln_88 = Line(StartPoint=geo_54, EndPoint=geo_56)  # disabled
merge = Merge(Data1=ln_29, Data2=ln_31, Data3=ln_33, Data4=ln_30, Data5=ln_32, Data6=ln_34)  # disabled
merge_2 = Merge(
    Data1=ln_35,
    Data2=ln_36,
    Data3=ln_37,
    Data4=ln_41,
    Data5=ln_38,
    Data6=ln_39,
    Data7=ln_40,
    Data8=ln_42,
    Data9=ln_43,
    Data10=ln_44,
    Data11=ln_45,
    Data12=ln_46,
    Data13=ln_47,
    Data14=ln_48,
    Data15=ln_49,
    Data16=ln_53,
    Data17=ln_50,
    Data18=ln_51,
    Data19=ln_52,
    Data20=ln_54,
    Data21=ln_55,
    Data22=ln_56,
    Data23=ln_57,
    Data24=ln_58)  # disabled
geo_59 = Geometry(merge_2)  # disabled
pipe = Pipe(Curve=merge, Radius=number_slider_6, Caps=0)  # disabled
merge_3 = Merge(Data1=ln_59, Data2=ln_61, Data3=ln_63, Data4=ln_60, Data5=ln_62, Data6=ln_64)  # disabled
len_6 = Length(Curve=geo_59)  # disabled
len_7 = Length(Curve=move_5.Geometry)  # disabled
merge_4 = Merge(
    Data1=ln_65,
    Data2=ln_66,
    Data3=ln_67,
    Data4=ln_71,
    Data5=ln_68,
    Data6=ln_69,
    Data7=ln_70,
    Data8=ln_72,
    Data9=ln_73,
    Data10=ln_74,
    Data11=ln_75,
    Data12=ln_76,
    Data13=ln_77,
    Data14=ln_78,
    Data15=ln_79,
    Data16=ln_83,
    Data17=ln_80,
    Data18=ln_81,
    Data19=ln_82,
    Data20=ln_84,
    Data21=ln_85,
    Data22=ln_86,
    Data23=ln_87,
    Data24=ln_88)  # disabled
geo_60 = Geometry(pipe)  # disabled
avr_6 = Average(Input=len_6)  # disabled
avr_7 = Average(Input=len_7)  # disabled
geo_61 = Geometry(merge_4)  # disabled
pipe_2 = Pipe(Curve=merge_3, Radius=number_slider_12, Caps=0)  # disabled
len_8 = Length(Curve=geo_61)  # disabled
len_9 = Length(Curve=move_7.Geometry)  # disabled
subtraction = Subtraction(A=avr_6, B=avr_7)  # disabled
geo_62 = Geometry(pipe_2)  # disabled
avr_8 = Average(Input=len_8)  # disabled
avr_9 = Average(Input=len_9)  # disabled
multiplication_17 = Multiplication(A=k_2, B=subtraction)  # disabled
division_8 = Division(A=loop_end, B=weight_2)  # disabled
velocity = Panel(division_8)  # disabled
subtraction_2 = Subtraction(A=avr_8, B=avr_9)  # disabled
ke_fg = Panel(multiplication_10)  # disabled
air_resistance = Panel(division_5)  # disabled
panel_24 = Panel(multiplication_17)  # disabled
multiplication_18 = Multiplication(A=k_3, B=subtraction_2)  # disabled
division_9 = Division(A=loop_end_3, B=weight_3)  # disabled
velocity_2 = Panel(division_9)  # disabled
ke_fg_2 = Panel(multiplication_13)  # disabled
panel_25 = Panel(multiplication_18)  # disabled
air_resistance_2 = Panel(division_6)  # disabled
ln_89 = Line(StartPoint=geo_13, EndPoint=geo_16)  # disabled
ln_90 = Line(StartPoint=geo_18, EndPoint=geo_20)  # disabled
ln_91 = Line(StartPoint=geo_14, EndPoint=geo_17)  # disabled
ln_92 = Line(StartPoint=geo_21, EndPoint=geo_23)  # disabled
ln_93 = Line(StartPoint=geo_15, EndPoint=geo_19)  # disabled
ln_94 = Line(StartPoint=geo_22, EndPoint=geo_24)  # disabled
ln_95 = Line(StartPoint=geo_13, EndPoint=geo_14)  # disabled
ln_96 = Line(StartPoint=geo_13, EndPoint=geo_15)  # disabled
ln_97 = Line(StartPoint=geo_14, EndPoint=geo_16)  # disabled
ln_98 = Line(StartPoint=geo_13, EndPoint=geo_23)  # disabled
ln_99 = Line(StartPoint=geo_17, EndPoint=geo_18)  # disabled
ln_100 = Line(StartPoint=geo_18, EndPoint=geo_19)  # disabled
ln_101 = Line(StartPoint=geo_16, EndPoint=geo_22)  # disabled
ln_102 = Line(StartPoint=geo_13, EndPoint=geo_21)  # disabled
ln_103 = Line(StartPoint=geo_19, EndPoint=geo_20)  # disabled
ln_104 = Line(StartPoint=geo_18, EndPoint=geo_21)  # disabled
ln_105 = Line(StartPoint=geo_19, EndPoint=geo_21)  # disabled
ln_106 = Line(StartPoint=geo_19, EndPoint=geo_22)  # disabled
ln_107 = Line(StartPoint=geo_14, EndPoint=geo_23)  # disabled
ln_108 = Line(StartPoint=geo_14, EndPoint=geo_24)  # disabled
ln_109 = Line(StartPoint=geo_15, EndPoint=geo_16)  # disabled
ln_110 = Line(StartPoint=geo_15, EndPoint=geo_22)  # disabled
ln_111 = Line(StartPoint=geo_16, EndPoint=geo_24)  # disabled
ln_112 = Line(StartPoint=geo_17, EndPoint=geo_20)  # disabled
ln_113 = Line(StartPoint=geo_15, EndPoint=geo_21)  # disabled
ln_114 = Line(StartPoint=geo_17, EndPoint=geo_23)  # disabled
ln_115 = Line(StartPoint=geo_17, EndPoint=geo_24)  # disabled
ln_116 = Line(StartPoint=geo_18, EndPoint=geo_23)  # disabled
ln_117 = Line(StartPoint=geo_20, EndPoint=geo_24)  # disabled
ln_118 = Line(StartPoint=geo_20, EndPoint=geo_22)  # disabled
merge_5 = Merge(Data1=ln_89, Data2=ln_91, Data3=ln_93, Data4=ln_90, Data5=ln_92, Data6=ln_94)  # disabled
merge_6 = Merge(
    Data1=ln_95,
    Data2=ln_96,
    Data3=ln_97,
    Data4=ln_101,
    Data5=ln_98,
    Data6=ln_99,
    Data7=ln_100,
    Data8=ln_102,
    Data9=ln_103,
    Data10=ln_104,
    Data11=ln_105,
    Data12=ln_106,
    Data13=ln_107,
    Data14=ln_108,
    Data15=ln_109,
    Data16=ln_113,
    Data17=ln_110,
    Data18=ln_111,
    Data19=ln_112,
    Data20=ln_114,
    Data21=ln_115,
    Data22=ln_116,
    Data23=ln_117,
    Data24=ln_118)  # disabled
merge_7 = Merge(
    Data1=ln,
    Data2=ln_2,
    Data3=ln_3,
    Data5=ln_5,
    Data6=ln_6,
    Data7=ln_7,
    Data8=ln_8,
    Data9=ln_9,
    Data10=ln_10,
    Data12=ln_13,
    Data13=ln_14,
    Data14=ln_15,
    Data15=ln_16,
    Data16=ln_17,
    Data18=ln_22,
    Data19=ln_23,
    Data20=ln_25,
    Data21=ln_26,
    Data22=ln_27,
    Data23=ln_28,
    Data25=ln_19,
    Data26=ln_20,
    Data27=ln_24)  # disabled
merge_8 = Merge(Data1=ln_4, Data2=ln_11, Data3=ln_21, Data4=ln_18)  # disabled
geo_63 = Geometry(merge_6)  # disabled
pipe_3 = Pipe(Curve=merge_5, Radius=number_slider_3, Caps=0)  # disabled
len_10 = Length(Curve=geo_63)  # disabled
len_11 = Length(Curve=split.ListA)  # disabled
geo_64 = Geometry(merge_7)  # disabled
geo_65 = Geometry(merge_8)  # disabled
geo_66 = Geometry(pipe_3)  # disabled
len_12 = Length(Curve=geo_64)  # disabled
avr_10 = Average(Input=len_10)  # disabled
avr_11 = Average(Input=len_11)  # disabled
len_13 = Length(Curve=geo_65)  # disabled
avr_12 = Average(Input=len_12)  # disabled
subtraction_3 = Subtraction(A=avr_10, B=avr_11)  # disabled
avr_13 = Average(Input=len_13)  # disabled
multiplication_19 = Multiplication(A=k, B=subtraction_3)  # disabled
division_10 = Division(A=loop_end_4, B=weight)  # disabled
panel_26 = Panel(avr_12)  # disabled
panel_27 = Panel(avr_13)  # disabled
velocity_3 = Panel(division_10)  # disabled
ke_fg_3 = Panel(multiplication_16)  # disabled
panel_28 = Panel(multiplication_19)  # disabled
air_resistance_3 = Panel(division_7)  # disabled
pt_2 = Point(Point(52.81789703, -1.448079771, 11.7788585))
pt_3 = Point(Point(56.56789835, 5.047111576, 11.77886421))
pt_4 = Point(Point(60.3178948, -1.448076688, 11.77886056))
pt_5 = Point(Point(50.50027115, 4.220134429, 7.448733589))
pt_6 = Point(Point(56.56789703, 7.723280664, 4.772571352))
pt_7 = Point(Point(56.56788914, -6.289301761, 7.448733839))
pt_8 = Point(Point(52.81789508, 2.882059844, 0.4424575919))
pt_9 = Point(Point(62.6355207, -2.78616056, 4.772565587))
pt_10 = Point(Point(56.56788932, -3.613134818, 0.4424416316))
pt_11 = Point(Point(62.63552506, 4.220132368, 7.448735164))
pt_12 = Point(Point(60.31789508, 2.882052385, 0.4424416316))
pt_13 = Point(Point(50.50027303, -2.786153621, 4.772585958))
pi_4 = Pi(Factor=1)
pi_5 = Pi(Factor=1)
pi_6 = Pi(Factor=1)
multiplication_20 = Multiplication(A=Slider(0, range=0..1), B=pi_4)
pt_14 = Point(Point(56.56789494, 0.7169887546, 6.11065402))
multiplication_21 = Multiplication(A=Slider(0, range=0..1), B=pi_5)
multiplication_22 = Multiplication(A=Slider(0, range=0..1), B=pi_6)
scale_5 = Scale(
    Geometry=[pt_2, pt_3, pt_4, pt_5, pt_13, pt_7, pt_6, pt_11, pt_8, pt_9, pt_10, pt_12],
    Center=pt_10,
    Factor=Slider(1, range=0..1))  # -> Geometry, Transform
X = UnitX(Factor=1)
Y_2 = UnitY(Factor=1)
pt_15 = Point(Point(56.56789494, 0.7169887546, 6.11065402))
rot3d = Rotate3D(Geometry=scale_5.Geometry, Angle=multiplication_20, Center=pt_15, Axis=X)  # -> Geometry, Transform
rot3d_2 = Rotate3D(Geometry=rot3d.Geometry, Angle=multiplication_21, Center=pt_15, Axis=Y_2)  # -> Geometry, Transform
rot3d_3 = Rotate3D(Geometry=rot3d_2.Geometry, Angle=multiplication_22, Center=pt_15, Axis=Vector(0, 0, 1))  # -> Geometry, Transform
panel_29 = Panel(rot3d_3.Geometry)
item_45 = ListItem(List=rot3d_3.Geometry, Index=Slider(4, range=0..100), Wrap=True)
item_46 = ListItem(List=rot3d_3.Geometry, Index=Slider(5, range=0..100), Wrap=True)
item_47 = ListItem(List=rot3d_3.Geometry, Index=Slider(3, range=0..100), Wrap=True)
item_48 = ListItem(List=rot3d_3.Geometry, Index=Slider(7, range=0..100), Wrap=True)
item_49 = ListItem(List=rot3d_3.Geometry, Index=Slider(6, range=0..100), Wrap=True)
item_50 = ListItem(List=rot3d_3.Geometry, Index=Slider(2, range=0..100), Wrap=True)
item_51 = ListItem(List=rot3d_3.Geometry, Index=Slider(8, range=0..100), Wrap=True)
item_52 = ListItem(List=rot3d_3.Geometry, Index=Slider(9, range=0..100), Wrap=True)
item_53 = ListItem(List=rot3d_3.Geometry, Index=Slider(1, range=0..100), Wrap=True)
item_54 = ListItem(List=rot3d_3.Geometry, Index=Slider(0, range=0..100), Wrap=True)
item_55 = ListItem(List=rot3d_3.Geometry, Index=Slider(10, range=0..100), Wrap=True)
item_56 = ListItem(List=rot3d_3.Geometry, Index=Slider(11, range=0..100), Wrap=True)
initial_z_4 = Slider(53, range=0..100)  # disabled
scale_6 = Slider(100, range=0..1000)  # disabled
number_slider_77 = Slider(100000, range=0..100000)  # disabled
number_slider_78 = Slider(0.3, range=0..1)  # disabled
initial_velocity_4 = Slider(0, range=0..100)  # disabled
gravity_5 = Slider(9.8, range=0..10)  # disabled
weight_4 = Slider(6, range=0..10)  # disabled
loop_index_5 = Slider(85, range=0..1000)  # disabled
k_4 = Slider(8000, range=0..10000)  # disabled
string_10 = Geometry(string_4)  # disabled
struts_10 = Geometry(struts_4)  # disabled
geo_67 = Geometry(geo_3)  # disabled
len_14 = Length(Curve=struts_10)  # disabled
_2_4 = Slider(2, range=0..10)  # disabled
number_slider_79 = Slider(3, range=0..10)  # disabled
air_density_kg_m3_4 = Slider(1.225, range=0..10)  # disabled
number_slider_80 = Slider(0.5, range=0..1)  # disabled
c_d_4 = Slider(1, range=0.7..1.2)  # disabled
Z_6 = UnitZ(Factor=initial_z_4)  # disabled
avr_14 = Average(Input=len_14)  # disabled
move_9 = Move(Geometry=[string_10, geo_67], Motion=Z_6)  # -> Geometry, Transform; disabled
pi_7 = Pi(Factor=1)  # disabled
move_10 = Move(Geometry=struts_10, Motion=Z_6)  # -> Geometry, Transform; disabled
number_slider_81 = Slider(24, range=0..100)  # disabled
multiplication_23 = Multiplication(A=_2_4, B=pi_7, C=number_slider_78, D=avr_14, E=number_slider_79)  # disabled
vec2pt = Vector2Pt(PointA=item_50, PointB=item_45, Unitize=False)  # -> Vector, Length
vec2pt_2 = Vector2Pt(PointA=item_54, PointB=item_49, Unitize=False)  # -> Vector, Length
vec2pt_3 = Vector2Pt(PointA=item_53, PointB=item_52, Unitize=False)  # -> Vector, Length
vec2pt_4 = Vector2Pt(PointA=item_48, PointB=item_51, Unitize=False)  # -> Vector, Length
vec2pt_5 = Vector2Pt(PointA=item_47, PointB=item_55, Unitize=False)  # -> Vector, Length
vec2pt_6 = Vector2Pt(PointA=item_46, PointB=item_56, Unitize=False)  # -> Vector, Length
loop_start_5 = LoopStart(Repeat=loop_index_5, Trigger=toggle_5, Data=initial_velocity_4)  # -> port, Counter, Data; disabled
division_11 = Division(A=gravity_5, B=scale_6)  # disabled
number_slider_82 = Slider(100000, range=0..100000)  # disabled
unit = UnitVector(Vector=vec2pt.Vector)
unit_2 = UnitVector(Vector=vec2pt_2.Vector)
unit_3 = UnitVector(Vector=vec2pt_3.Vector)
unit_4 = UnitVector(Vector=vec2pt_4.Vector)
unit_5 = UnitVector(Vector=vec2pt_5.Vector)
unit_6 = UnitVector(Vector=vec2pt_6.Vector)
addition_8 = Addition(A=loop_start_5.Data, B=division_11)  # disabled
split_2 = SplitList(List=move_9.Geometry, Index=number_slider_81)  # -> ListA, ListB; disabled
number_slider_83 = Slider(2, range=0..10)  # disabled
number_slider_84 = Slider(-0.5, range=-0.5..0.5)  # disabled
multiplication_24 = Multiplication(A=unit, B=vec2pt.Length)
multiplication_25 = Multiplication(A=unit_2, B=vec2pt_2.Length)
multiplication_26 = Multiplication(A=unit_4, B=vec2pt_4.Length)
multiplication_27 = Multiplication(A=unit_5, B=vec2pt_5.Length)
multiplication_28 = Multiplication(A=unit_6, B=vec2pt_6.Length)
multiplication_29 = Multiplication(A=unit_3, B=vec2pt_3.Length)
loop_end_5 = LoopEnd(port=loop_start_5.port, Exit=False, Data=addition_8, TimeOutVal=0, pausedState=False, state="Constant output")  # disabled
addition_9 = Addition(A=item_54, B=multiplication_25)
addition_10 = Addition(A=item_50, B=multiplication_24)
addition_11 = Addition(A=item_53, B=multiplication_29)
addition_12 = Addition(A=item_48, B=multiplication_26)
geo_68 = Geometry(split_2.ListB)  # disabled
addition_13 = Addition(A=item_47, B=multiplication_27)
addition_14 = Addition(A=item_46, B=multiplication_28)
floor_5 = Floor(Strength=number_slider_82)  # disabled
pl_4 = PlasticLength(Line=move_9.Geometry, Limit=1, Strength=k_4)  # disabled
pow_4 = Power(A=loop_end_5, B=number_slider_83)  # disabled
multiplication_30 = Multiplication(A=number_slider_80, B=air_density_kg_m3_4, C=c_d_4, D=pow_4, E=multiplication_23)  # disabled
division_12 = Division(A=multiplication_30, B=scale_6)  # disabled
ct_4 = ConstantTension(Line=move_9.Geometry, Strength=k_4)  # disabled
multiplication_31 = Multiplication(A=pow_4, B=weight_4, C=number_slider_84)  # disabled
addition_15 = Addition(A=multiplication_31, B=division_12)  # disabled
dw_4 = DynamicWeight1d(Line=move_10.Geometry, Weight=addition_15)  # disabled
length_line_4 = LengthLine(Line=move_10.Geometry, Strength=number_slider_77)  # disabled
panel_30 = Panel(ct_4)  # disabled
bouncysolver_5 = BouncySolver(
    GoalObjects=[pl_4, dw_4, floor_5, length_line_4, ct_4],
    Reset=button_5,
    Threshold=1e-15,
    Tolerance=0.0001,
    Damping=0.99,
    Iterations=10,
    On=toggle_5)  # -> I, V, O; disabled
number_slider_85 = Slider(0, range=0..100)  # disabled
number_slider_86 = Slider(1, range=0..100)  # disabled
number_slider_87 = Slider(2, range=0..100)  # disabled
number_slider_88 = Slider(3, range=0..100)  # disabled
number_slider_89 = Slider(4, range=0..100)  # disabled
number_slider_90 = Slider(5, range=0..100)  # disabled
number_slider_91 = Slider(6, range=0..100)  # disabled
number_slider_92 = Slider(7, range=0..100)  # disabled
number_slider_93 = Slider(8, range=0..100)  # disabled
number_slider_94 = Slider(9, range=0..100)  # disabled
number_slider_95 = Slider(10, range=0..100)  # disabled
number_slider_96 = Slider(11, range=0..100)  # disabled
number_slider_97 = Slider(12, range=0..100)  # disabled
number_slider_98 = Slider(13, range=0..100)  # disabled
number_slider_99 = Slider(14, range=0..100)  # disabled
number_slider_100 = Slider(15, range=0..100)  # disabled
number_slider_101 = Slider(16, range=0..100)  # disabled
number_slider_102 = Slider(17, range=0..100)  # disabled
number_slider_103 = Slider(18, range=0..100)  # disabled
number_slider_104 = Slider(19, range=0..100)  # disabled
geo_69 = Geometry(bouncysolver_5.V)  # disabled
panel_31 = Panel(geo_69)  # disabled
item_57 = ListItem(List=geo_69, Index=number_slider_85, Wrap=True)  # disabled
item_58 = ListItem(List=geo_69, Index=number_slider_86, Wrap=True)  # disabled
item_59 = ListItem(List=geo_69, Index=number_slider_87, Wrap=True)  # disabled
item_60 = ListItem(List=geo_69, Index=number_slider_88, Wrap=True)  # disabled
item_61 = ListItem(List=geo_69, Index=number_slider_89, Wrap=True)  # disabled
item_62 = ListItem(List=geo_69, Index=number_slider_90, Wrap=True)  # disabled
item_63 = ListItem(List=geo_69, Index=number_slider_91, Wrap=True)  # disabled
item_64 = ListItem(List=geo_69, Index=number_slider_92, Wrap=True)  # disabled
item_65 = ListItem(List=geo_69, Index=number_slider_93, Wrap=True)  # disabled
item_66 = ListItem(List=geo_69, Index=number_slider_94, Wrap=True)  # disabled
item_67 = ListItem(List=geo_69, Index=number_slider_95, Wrap=True)  # disabled
item_68 = ListItem(List=geo_69, Index=number_slider_96, Wrap=True)  # disabled
item_69 = ListItem(List=geo_69, Index=number_slider_97, Wrap=True)  # disabled
item_70 = ListItem(List=geo_69, Index=number_slider_98, Wrap=True)  # disabled
item_71 = ListItem(List=geo_69, Index=number_slider_99, Wrap=True)  # disabled
item_72 = ListItem(List=geo_69, Index=number_slider_100, Wrap=True)  # disabled
item_73 = ListItem(List=geo_69, Index=number_slider_101, Wrap=True)  # disabled
item_74 = ListItem(List=geo_69, Index=number_slider_102, Wrap=True)  # disabled
move_11 = Move(Geometry=item_54, Motion=Vector(0, 0, 10))  # -> Geometry, Transform
move_12 = Move(Geometry=addition_12, Motion=Vector(0, 0, 10))  # -> Geometry, Transform
move_13 = Move(Geometry=addition_9, Motion=Vector(0, 0, 10))  # -> Geometry, Transform
move_14 = Move(Geometry=item_48, Motion=Vector(0, 0, 10))  # -> Geometry, Transform
move_15 = Move(Geometry=addition_13, Motion=Vector(0, 0, 10))  # -> Geometry, Transform
move_16 = Move(Geometry=addition_14, Motion=Vector(0, 0, 10))  # -> Geometry, Transform
move_17 = Move(Geometry=item_50, Motion=Vector(0, 0, 10))  # -> Geometry, Transform
move_18 = Move(Geometry=addition_11, Motion=Vector(0, 0, 10))  # -> Geometry, Transform
item_75 = ListItem(List=geo_69, Index=number_slider_103, Wrap=True)  # disabled
item_76 = ListItem(List=geo_69, Index=number_slider_104, Wrap=True)  # disabled
move_19 = Move(Geometry=item_53, Motion=Vector(0, 0, 10))  # -> Geometry, Transform
move_20 = Move(Geometry=addition_10, Motion=Vector(0, 0, 10))  # -> Geometry, Transform
move_21 = Move(Geometry=item_46, Motion=Vector(0, 0, 10))  # -> Geometry, Transform
move_22 = Move(Geometry=item_47, Motion=Vector(0, 0, 10))  # -> Geometry, Transform

toggle_6 = BooleanToggle(True)
pline = PolyLine(Vertices=[addition_12, addition_13, addition_14], Closed=toggle_6)
pline_2 = PolyLine(Vertices=[item_54, item_53, item_50], Closed=toggle_6)
pline_3 = PolyLine(Vertices=[addition_11, addition_14, item_48], Closed=toggle_6)
pline_4 = PolyLine(Vertices=[addition_10, item_54, item_47], Closed=toggle_6)
pline_5 = PolyLine(Vertices=[addition_9, item_53, item_48], Closed=toggle_6)
pline_6 = PolyLine(Vertices=[addition_9, addition_12, item_47], Closed=toggle_6)
pline_7 = PolyLine(Vertices=[addition_10, addition_13, item_46], Closed=toggle_6)
pline_8 = PolyLine(Vertices=[addition_11, item_50, item_46], Closed=toggle_6)
area_2 = Area(Geometry=pline_2)  # -> Area, Centroid
area_3 = Area(Geometry=pline)  # -> Area, Centroid
area_4 = Area(Geometry=pline_3)  # -> Area, Centroid
area_5 = Area(Geometry=pline_4)  # -> Area, Centroid
area_6 = Area(Geometry=pline_5)  # -> Area, Centroid
area_7 = Area(Geometry=pline_6)  # -> Area, Centroid
area_8 = Area(Geometry=pline_7)  # -> Area, Centroid
area_9 = Area(Geometry=pline_8)  # -> Area, Centroid
move_23 = Move(Geometry=area_6.Centroid, Motion=Vector(0, 0, 10))  # -> Geometry, Transform
move_24 = Move(Geometry=area_3.Centroid, Motion=Vector(0, 0, 10))  # -> Geometry, Transform
move_25 = Move(Geometry=area_4.Centroid, Motion=Vector(0, 0, 10))  # -> Geometry, Transform
move_26 = Move(Geometry=area_2.Centroid, Motion=Vector(0, 0, 10))  # -> Geometry, Transform
move_27 = Move(Geometry=area_9.Centroid, Motion=Vector(0, 0, 10))  # -> Geometry, Transform
move_28 = Move(Geometry=area_8.Centroid, Motion=Vector(0, 0, 10))  # -> Geometry, Transform
move_29 = Move(Geometry=area_7.Centroid, Motion=Vector(0, 0, 10))  # -> Geometry, Transform
move_30 = Move(Geometry=area_5.Centroid, Motion=Vector(0, 0, 10))  # -> Geometry, Transform
ln_119 = Line(StartPoint=move_25.Geometry, EndPoint=move_16.Geometry)
ln_120 = Line(StartPoint=move_25.Geometry, EndPoint=move_14.Geometry)
ln_121 = Line(StartPoint=move_25.Geometry, EndPoint=move_18.Geometry)
ln_122 = Line(StartPoint=move_24.Geometry, EndPoint=move_12.Geometry)
ln_123 = Line(StartPoint=move_24.Geometry, EndPoint=move_15.Geometry)
ln_124 = Line(StartPoint=move_24.Geometry, EndPoint=move_16.Geometry)
ln_125 = Line(StartPoint=move_26.Geometry, EndPoint=move_24.Geometry)
ln_126 = Line(StartPoint=move_30.Geometry, EndPoint=move_25.Geometry)
ln_127 = Line(StartPoint=move_29.Geometry, EndPoint=move_13.Geometry)
ln_128 = Line(StartPoint=move_29.Geometry, EndPoint=move_12.Geometry)
ln_129 = Line(StartPoint=move_28.Geometry, EndPoint=move_15.Geometry)
ln_130 = Line(StartPoint=move_29.Geometry, EndPoint=move_22.Geometry)
ln_131 = Line(StartPoint=move_27.Geometry, EndPoint=move_29.Geometry)
ln_132 = Line(StartPoint=move_30.Geometry, EndPoint=move_11.Geometry)
ln_133 = Line(StartPoint=move_30.Geometry, EndPoint=move_20.Geometry)
ln_134 = Line(StartPoint=move_28.Geometry, EndPoint=move_20.Geometry)
ln_135 = Line(StartPoint=move_28.Geometry, EndPoint=move_21.Geometry)
ln_136 = Line(StartPoint=move_23.Geometry, EndPoint=move_28.Geometry)
ln_137 = Line(StartPoint=move_27.Geometry, EndPoint=move_17.Geometry)
ln_138 = Line(StartPoint=move_27.Geometry, EndPoint=move_18.Geometry)
ln_139 = Line(StartPoint=move_26.Geometry, EndPoint=move_11.Geometry)
ln_140 = Line(StartPoint=move_26.Geometry, EndPoint=move_17.Geometry)
ln_141 = Line(StartPoint=move_30.Geometry, EndPoint=move_22.Geometry)
ln_142 = Line(StartPoint=move_23.Geometry, EndPoint=move_19.Geometry)
ln_143 = Line(StartPoint=move_23.Geometry, EndPoint=move_14.Geometry)
ln_144 = Line(StartPoint=move_27.Geometry, EndPoint=move_21.Geometry)
ln_145 = Line(StartPoint=move_26.Geometry, EndPoint=move_19.Geometry)
ln_146 = Line(StartPoint=move_23.Geometry, EndPoint=move_13.Geometry)
merge_9 = Merge(
    Data1=ln_142,
    Data2=ln_146,
    Data3=ln_143,
    Data4=ln_137,
    Data5=ln_144,
    Data6=ln_138,
    Data7=ln_139,
    Data8=ln_145,
    Data9=ln_140,
    Data10=ln_132,
    Data11=ln_141,
    Data12=ln_133,
    Data13=ln_134,
    Data14=ln_135,
    Data15=ln_129,
    Data16=ln_130,
    Data17=ln_127,
    Data18=ln_128,
    Data19=ln_122,
    Data20=ln_123,
    Data21=ln_124,
    Data22=ln_120,
    Data23=ln_121,
    Data24=ln_119)
merge_10 = Merge(Data1=ln_136, Data2=ln_131, Data3=ln_125, Data4=ln_126)
merge_11 = Merge(Data1=merge_9, Data2=merge_10)
move_31 = Move(Geometry=merge_11, Motion=Vector(0, 0, 10))  # -> Geometry, Transform

geo_70 = Geometry(item_57)  # disabled
geo_71 = Geometry(item_58)  # disabled
geo_72 = Geometry(item_59)  # disabled
geo_73 = Geometry(item_60)  # disabled
geo_74 = Geometry(item_61)  # disabled
geo_75 = Geometry(item_62)  # disabled
geo_76 = Geometry(item_63)  # disabled
geo_77 = Geometry(item_64)  # disabled
geo_78 = Geometry(item_65)  # disabled
geo_79 = Geometry(item_66)  # disabled
geo_80 = Geometry(item_67)  # disabled
geo_81 = Geometry(item_68)  # disabled
geo_82 = Geometry(item_69)  # disabled
geo_83 = Geometry(item_70)  # disabled
geo_84 = Geometry(item_71)  # disabled
geo_85 = Geometry(item_72)  # disabled
geo_86 = Geometry(item_73)  # disabled
geo_87 = Geometry(item_74)  # disabled
geo_88 = Geometry(item_75)  # disabled
geo_89 = Geometry(item_76)  # disabled
ln_147 = Line(StartPoint=geo_82, EndPoint=geo_70)  # disabled
ln_148 = Line(StartPoint=geo_82, EndPoint=geo_72)  # disabled
ln_149 = Line(StartPoint=geo_82, EndPoint=geo_78)  # disabled
ln_150 = Line(StartPoint=geo_82, EndPoint=geo_83)  # disabled
ln_151 = Line(StartPoint=geo_83, EndPoint=geo_74)  # disabled
ln_152 = Line(StartPoint=geo_83, EndPoint=geo_77)  # disabled
ln_153 = Line(StartPoint=geo_83, EndPoint=geo_81)  # disabled
ln_154 = Line(StartPoint=geo_84, EndPoint=geo_72)  # disabled
ln_155 = Line(StartPoint=geo_84, EndPoint=geo_73)  # disabled
ln_156 = Line(StartPoint=geo_84, EndPoint=geo_79)  # disabled
ln_157 = Line(StartPoint=geo_84, EndPoint=geo_85)  # disabled
ln_158 = Line(StartPoint=geo_85, EndPoint=geo_74)  # disabled
ln_159 = Line(StartPoint=geo_85, EndPoint=geo_75)  # disabled
ln_160 = Line(StartPoint=geo_85, EndPoint=geo_80)  # disabled
ln_161 = Line(StartPoint=geo_86, EndPoint=geo_73)  # disabled
ln_162 = Line(StartPoint=geo_86, EndPoint=geo_71)  # disabled
ln_163 = Line(StartPoint=geo_86, EndPoint=geo_81)  # disabled
ln_164 = Line(StartPoint=geo_88, EndPoint=geo_89)  # disabled
ln_165 = Line(StartPoint=geo_89, EndPoint=geo_70)  # disabled
ln_166 = Line(StartPoint=geo_89, EndPoint=geo_71)  # disabled
ln_167 = Line(StartPoint=geo_86, EndPoint=geo_87)  # disabled
ln_168 = Line(StartPoint=geo_87, EndPoint=geo_75)  # disabled
ln_169 = Line(StartPoint=geo_87, EndPoint=geo_76)  # disabled
ln_170 = Line(StartPoint=geo_89, EndPoint=geo_80)  # disabled
ln_171 = Line(StartPoint=geo_87, EndPoint=geo_78)  # disabled
ln_172 = Line(StartPoint=geo_88, EndPoint=geo_76)  # disabled
ln_173 = Line(StartPoint=geo_88, EndPoint=geo_77)  # disabled
ln_174 = Line(StartPoint=geo_88, EndPoint=geo_79)  # disabled

toggle_7 = BooleanToggle(True)
pline_9 = PolyLine(Vertices=[addition_12, addition_13, addition_14], Closed=toggle_7)
pline_10 = PolyLine(Vertices=[item_54, item_53, item_50], Closed=toggle_7)
area_10 = Area(Geometry=pline_10)  # -> Area, Centroid
area_11 = Area(Geometry=pline_9)  # -> Area, Centroid
ln_175 = Line(StartPoint=area_11.Centroid, EndPoint=area_10.Centroid)
midpt = CurveMiddle(Curve=ln_175)
ln_176 = Line(StartPoint=addition_13, EndPoint=midpt)
ln_177 = Line(StartPoint=addition_11, EndPoint=midpt)
ln_178 = Line(StartPoint=addition_12, EndPoint=midpt)
ln_179 = Line(StartPoint=item_48, EndPoint=midpt)
ln_180 = Line(StartPoint=item_47, EndPoint=midpt)
ln_181 = Line(StartPoint=addition_10, EndPoint=midpt)
ln_182 = Line(StartPoint=item_50, EndPoint=midpt)
ln_183 = Line(StartPoint=item_53, EndPoint=midpt)
move_32 = Move(Geometry=[ln_183, ln_182, ln_180, ln_181, ln_179, ln_178, ln_177, ln_176], Motion=Vector(0, 0, 10))  # -> Geometry, Transform
merge_12 = Merge(Data1=move_32.Geometry)
move_33 = Move(Geometry=merge_12, Motion=Vector(0, 0, 10))  # -> Geometry, Transform

ln_184 = Line(StartPoint=move_14.Geometry, EndPoint=move_12.Geometry)
ln_185 = Line(StartPoint=move_11.Geometry, EndPoint=move_19.Geometry)
ln_186 = Line(StartPoint=move_17.Geometry, EndPoint=move_20.Geometry)
ln_187 = Line(StartPoint=move_21.Geometry, EndPoint=move_16.Geometry)
ln_188 = Line(StartPoint=geo_70, EndPoint=geo_73)  # disabled
ln_189 = Line(StartPoint=move_11.Geometry, EndPoint=move_17.Geometry)
ln_190 = Line(StartPoint=move_15.Geometry, EndPoint=move_16.Geometry)
ln_191 = Line(StartPoint=move_19.Geometry, EndPoint=move_18.Geometry)
ln_192 = Line(StartPoint=move_22.Geometry, EndPoint=move_15.Geometry)
ln_193 = Line(StartPoint=geo_75, EndPoint=geo_77)  # disabled
ln_194 = Line(StartPoint=move_11.Geometry, EndPoint=move_22.Geometry)
ln_195 = Line(StartPoint=move_11.Geometry, EndPoint=move_20.Geometry)
ln_196 = Line(StartPoint=move_13.Geometry, EndPoint=move_12.Geometry)
ln_197 = Line(StartPoint=move_12.Geometry, EndPoint=move_15.Geometry)
ln_198 = Line(StartPoint=move_18.Geometry, EndPoint=move_16.Geometry)
ln_199 = Line(StartPoint=move_11.Geometry, EndPoint=move_13.Geometry)
ln_200 = Line(StartPoint=geo_71, EndPoint=geo_74)  # disabled
ln_201 = Line(StartPoint=geo_78, EndPoint=geo_80)  # disabled
ln_202 = Line(StartPoint=move_19.Geometry, EndPoint=move_17.Geometry)
ln_203 = Line(StartPoint=move_20.Geometry, EndPoint=move_21.Geometry)
ln_204 = Line(StartPoint=move_13.Geometry, EndPoint=move_14.Geometry)
ln_205 = Line(StartPoint=move_14.Geometry, EndPoint=move_18.Geometry)
ln_206 = Line(StartPoint=move_12.Geometry, EndPoint=move_15.Geometry)
ln_207 = Line(StartPoint=geo_72, EndPoint=geo_76)  # disabled
ln_208 = Line(StartPoint=geo_79, EndPoint=geo_81)  # disabled
ln_209 = Line(StartPoint=move_19.Geometry, EndPoint=move_13.Geometry)
ln_210 = Line(StartPoint=move_17.Geometry, EndPoint=move_21.Geometry)
ln_211 = Line(StartPoint=move_22.Geometry, EndPoint=move_12.Geometry)
ln_212 = Line(StartPoint=move_20.Geometry, EndPoint=move_15.Geometry)
ln_213 = Line(StartPoint=move_21.Geometry, EndPoint=move_15.Geometry)
ln_214 = Line(StartPoint=move_14.Geometry, EndPoint=move_16.Geometry)
ln_215 = Line(StartPoint=move_19.Geometry, EndPoint=move_14.Geometry)
ln_216 = Line(StartPoint=move_17.Geometry, EndPoint=move_18.Geometry)
ln_217 = Line(StartPoint=move_22.Geometry, EndPoint=move_13.Geometry)
ln_218 = Line(StartPoint=move_21.Geometry, EndPoint=move_18.Geometry)
ln_219 = Line(StartPoint=move_22.Geometry, EndPoint=move_20.Geometry)
ln_220 = Line(StartPoint=geo_70, EndPoint=geo_71)  # disabled
ln_221 = Line(StartPoint=geo_70, EndPoint=geo_72)  # disabled
ln_222 = Line(StartPoint=geo_71, EndPoint=geo_73)  # disabled
ln_223 = Line(StartPoint=geo_70, EndPoint=geo_80)  # disabled
ln_224 = Line(StartPoint=geo_74, EndPoint=geo_75)  # disabled
ln_225 = Line(StartPoint=geo_75, EndPoint=geo_76)  # disabled
ln_226 = Line(StartPoint=geo_73, EndPoint=geo_79)  # disabled
ln_227 = Line(StartPoint=geo_70, EndPoint=geo_78)  # disabled
ln_228 = Line(StartPoint=geo_76, EndPoint=geo_77)  # disabled
ln_229 = Line(StartPoint=geo_75, EndPoint=geo_78)  # disabled
ln_230 = Line(StartPoint=geo_76, EndPoint=geo_78)  # disabled
ln_231 = Line(StartPoint=geo_76, EndPoint=geo_79)  # disabled
ln_232 = Line(StartPoint=geo_71, EndPoint=geo_80)  # disabled
ln_233 = Line(StartPoint=geo_71, EndPoint=geo_81)  # disabled
ln_234 = Line(StartPoint=geo_72, EndPoint=geo_73)  # disabled
ln_235 = Line(StartPoint=geo_72, EndPoint=geo_79)  # disabled
ln_236 = Line(StartPoint=geo_73, EndPoint=geo_81)  # disabled
ln_237 = Line(StartPoint=geo_74, EndPoint=geo_77)  # disabled
ln_238 = Line(StartPoint=geo_72, EndPoint=geo_78)  # disabled
ln_239 = Line(StartPoint=geo_74, EndPoint=geo_80)  # disabled
ln_240 = Line(StartPoint=geo_74, EndPoint=geo_81)  # disabled
ln_241 = Line(StartPoint=geo_75, EndPoint=geo_80)  # disabled
ln_242 = Line(StartPoint=geo_77, EndPoint=geo_81)  # disabled
ln_243 = Line(StartPoint=geo_77, EndPoint=geo_79)  # disabled
merge_13 = Merge(
    Data1=ln_185,
    Data2=ln_189,
    Data3=ln_194,
    Data4=ln_195,
    Data5=ln_202,
    Data6=ln_209,
    Data7=ln_215,
    Data8=ln_210,
    Data9=ln_216,
    Data10=ln_219,
    Data11=ln_217,
    Data12=ln_211,
    Data13=ln_203,
    Data14=ln_212,
    Data15=ln_218,
    Data16=ln_213,
    Data17=ln_204,
    Data18=ln_196,
    Data19=ln_205,
    Data20=ln_214,
    Data21=ln_206,
    Data22=ln_197,
    Data23=ln_198,
    Data24=ln_190)
merge_14 = Merge(Data1=ln_199, Data2=ln_191, Data3=ln_186, Data4=ln_192, Data5=ln_187, Data6=ln_184)
merge_15 = Merge(Data1=ln_188, Data2=ln_200, Data3=ln_207, Data4=ln_193, Data5=ln_201, Data6=ln_208)  # disabled
merge_16 = Merge(
    Data1=ln_220,
    Data2=ln_221,
    Data3=ln_222,
    Data4=ln_226,
    Data5=ln_223,
    Data6=ln_224,
    Data7=ln_225,
    Data8=ln_227,
    Data9=ln_228,
    Data10=ln_229,
    Data11=ln_230,
    Data12=ln_231,
    Data13=ln_232,
    Data14=ln_233,
    Data15=ln_234,
    Data16=ln_238,
    Data17=ln_235,
    Data18=ln_236,
    Data19=ln_237,
    Data20=ln_239,
    Data21=ln_240,
    Data22=ln_241,
    Data23=ln_242,
    Data24=ln_243)  # disabled
merge_17 = Merge(
    Data1=ln_147,
    Data2=ln_148,
    Data3=ln_149,
    Data5=ln_151,
    Data6=ln_152,
    Data7=ln_153,
    Data8=ln_154,
    Data9=ln_155,
    Data10=ln_156,
    Data12=ln_159,
    Data13=ln_160,
    Data14=ln_161,
    Data15=ln_162,
    Data16=ln_163,
    Data18=ln_168,
    Data19=ln_169,
    Data20=ln_171,
    Data21=ln_172,
    Data22=ln_173,
    Data23=ln_174,
    Data25=ln_165,
    Data26=ln_166,
    Data27=ln_170)  # disabled
merge_18 = Merge(Data1=ln_150, Data2=ln_157, Data3=ln_167, Data4=ln_164)  # disabled
move_34 = Move(Geometry=merge_13, Motion=Vector(0, 0, 10))  # -> Geometry, Transform
move_35 = Move(Geometry=merge_14, Motion=Vector(0, 0, 10))  # -> Geometry, Transform
geo_90 = Geometry(merge_16)  # disabled
pipe_4 = Pipe(Curve=merge_15, Radius=number_slider_78, Caps=0)  # disabled
len_15 = Length(Curve=geo_90)  # disabled
len_16 = Length(Curve=split_2.ListA)  # disabled
geo_91 = Geometry(merge_17)  # disabled
geo_92 = Geometry(merge_18)  # disabled
geo_93 = Geometry(pipe_4)  # disabled
len_17 = Length(Curve=geo_91)  # disabled
avr_15 = Average(Input=len_15)  # disabled
avr_16 = Average(Input=len_16)  # disabled
len_18 = Length(Curve=geo_92)  # disabled
avr_17 = Average(Input=len_17)  # disabled
subtraction_4 = Subtraction(A=avr_15, B=avr_16)  # disabled
avr_18 = Average(Input=len_18)  # disabled
geo_94 = Geometry(move_35.Geometry)
multiplication_32 = Multiplication(A=k_4, B=subtraction_4)  # disabled
division_13 = Division(A=loop_end_5, B=weight_4)  # disabled
panel_32 = Panel(avr_17)  # disabled
panel_33 = Panel(avr_18)  # disabled
velocity_4 = Panel(division_13)  # disabled
ke_fg_4 = Panel(multiplication_31)  # disabled
panel_34 = Panel(multiplication_32)  # disabled
air_resistance_4 = Panel(division_12)  # disabled
geo_95 = Geometry([move_34.Geometry, move_31.Geometry])
number_slider_105 = Slider(100, range=0..100)
geo_96 = Geometry(geo_94)
crosec = CrossSectionKaramba3D(
    FamilyNameOfCrossSection="DefaultCroSec",
    Diameter_cm=Slider(50, range=0..1000),
    WallThickness_cm=0.4,
    mode="Circular Hollow")
end = EndPoints(Curve=geo_96)  # -> Start, End
loads = LoadsKaramba3D(Vector=Vector(0, 0, -1), LCase="LC0", mode="Gravity")
lineelem = CreateLinearElementKaramba3D(
    Line=geo_96,
    CrossSection=crosec,
    LimitDistance_m=0.005,
    BucklingLengthY_m=-1,
    BucklingLengthZ_m=-1,
    BucklingLengthLT_m=-1,
    Bending=True,
    ToPolylineMaxAngle=0.03,
    ToPolylineTolerance=0.01,
    ToPolylineMaxEdgeLength=0.25,
    New=True,
    Remove=True,
    mode="LineToBeam")  # -> Element, Points, Info
supp = SupportKaramba3D(PosInd=[end.Start, end.End], menu=[buttons(on, on, on, on, on, on)])
lineelem_2 = CreateLinearElementKaramba3D(
    Line=geo_95,
    LimitDistance_m=0.005,
    BucklingLengthY_m=-1,
    BucklingLengthZ_m=-1,
    BucklingLengthLT_m=-1,
    Bending=True,
    ToPolylineMaxAngle=0.03,
    ToPolylineTolerance=0.01,
    ToPolylineMaxEdgeLength=0.25,
    New=True,
    Remove=True,
    mode="LineToBeam")  # -> Element, Points, Info
merge_19 = Merge(Data1=lineelem.Element, Data2=lineelem_2.Element)
assemble = AssembleModelKaramba3D(Elem=flatten(merge_19), Support=flatten(supp), Load=flatten(loads), LimitDistance_m=0.005)  # -> Model, Info, Mass_kg, CentreOfGravity, LoadCaseNames
range = Range(Domain=Domain(0, 1), Steps=Slider(20, range=0..100))
analyse = AnalyseKaramba3D(Model=assemble.Model)  # -> AnalysedModel, MaximumDisplacement_cm, ResultingForce_kN, ChangeOfElasticEnergy_kNm
gradient = Gradient(
    LowerLimit=0,
    UpperLimit=1,
    Parameter=range,
    stops=[0: RGB(255, 0, 0), 0: RGB(9, 76, 55), 0: RGB(132, 144, 38), 0: RGB(31, 6, 52), 0: RGB(194, 161, 80), 0: RGB(243, 57, 0), 0.1: RGB(255, 0, 0), 0.2: RGB(255, 128, 128), 0.3: RGB(255, 255, 0), 0.4: RGB(0, 192, 192)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])
modelview = ModelViewKaramba3D(Model=analyse.AnalysedModel, Colours=gradient)  # -> Model, DeformedMesh, DeformedAxes, DeformedModel, MaximumDeformation
beamview = BeamViewKaramba3D(Model=modelview.Model)  # -> Model, MeshesOfRenderedBeams, DeformedBeamAxes, LegendColours, LegendTags
shellview = ShellViewKaramba3D(Model=modelview.Model, IndexOfLayer=0)  # -> Model, MeshesOfRenderedShells, LegendColours, LegendTags; disabled
pt_16 = Point(Point(52.81789703, -1.448079771, 11.7788585))  # disabled
pt_17 = Point(Point(56.56789835, 5.047111576, 11.77886421))  # disabled
pt_18 = Point(Point(60.3178948, -1.448076688, 11.77886056))  # disabled
pt_19 = Point(Point(50.50027115, 4.220134429, 7.448733589))  # disabled
pt_20 = Point(Point(56.56789703, 7.723280664, 4.772571352))  # disabled
pt_21 = Point(Point(56.56788914, -6.289301761, 7.448733839))  # disabled
pt_22 = Point(Point(52.81789508, 2.882059844, 0.4424575919))  # disabled
pt_23 = Point(Point(62.6355207, -2.78616056, 4.772565587))  # disabled
pt_24 = Point(Point(56.56788932, -3.613134818, 0.4424416316))  # disabled
pt_25 = Point(Point(62.63552506, 4.220132368, 7.448735164))  # disabled
pt_26 = Point(Point(60.31789508, 2.882052385, 0.4424416316))  # disabled
pt_27 = Point(Point(50.50027303, -2.786153621, 4.772585958))  # disabled
legend = Legend(Colour=beamview.LegendColours, Tags=beamview.LegendTags, LegendType=101)
number_slider_106 = Slider(1, range=0..10)  # disabled
legend_2 = Legend(Colour=shellview.LegendColours, Tags=shellview.LegendTags, LegendType=1)
panel_35 = Panel(analyse.ResultingForce_kN)
number_slider_107 = Slider(4, range=0..100)  # disabled
number_slider_108 = Slider(5, range=0..100)  # disabled
number_slider_109 = Slider(3, range=0..100)  # disabled
number_slider_110 = Slider(7, range=0..100)  # disabled
number_slider_111 = Slider(6, range=0..100)  # disabled
number_slider_112 = Slider(2, range=0..100)  # disabled
number_slider_113 = Slider(8, range=0..100)  # disabled
number_slider_114 = Slider(9, range=0..100)  # disabled
number_slider_115 = Slider(0, range=0..100)  # disabled
number_slider_116 = Slider(1, range=0..100)  # disabled
number_slider_117 = Slider(10, range=0..100)  # disabled
number_slider_118 = Slider(11, range=0..100)  # disabled
initial_z_5 = Slider(50, range=0..100)  # disabled
scale_7 = Slider(100, range=0..1000)  # disabled
number_slider_119 = Slider(100000, range=0..100000)  # disabled
number_slider_120 = Slider(0.3, range=0..1)  # disabled
pipe_5 = Pipe(Curve=move_35.Geometry, Radius=number_slider_120, Caps=0)  # disabled
loop_index_6 = Slider(331, range=0..1000)  # disabled
initial_velocity_5 = Slider(0, range=0..100)  # disabled
gravity_6 = Slider(9.8, range=0..10)  # disabled
k_5 = Slider(10000, range=0..10000)  # disabled
_2_5 = Slider(2, range=0..10)  # disabled
number_slider_121 = Slider(3, range=0..10)  # disabled
air_density_kg_m3_5 = Slider(1.225, range=0..10)  # disabled
number_slider_122 = Slider(0.5, range=0..1)  # disabled
c_d_5 = Slider(1, range=0.7..1.2)  # disabled
Z_7 = UnitZ(Factor=initial_z_5)  # disabled
pi_8 = Pi(Factor=1)  # disabled
number_slider_123 = Slider(24, range=0..100)  # disabled
division_14 = Division(A=gravity_6, B=scale_7)  # disabled
number_slider_124 = Slider(100000, range=0..100000)  # disabled
number_slider_125 = Slider(2, range=0..10)  # disabled
number_slider_126 = Slider(-0.5, range=-0.5..0.5)  # disabled
floor_6 = Floor(Strength=number_slider_124)  # disabled
number_slider_127 = Slider(12, range=0..100)  # disabled
number_slider_128 = Slider(9, range=0..100)  # disabled
number_slider_129 = Slider(5, range=0..100)  # disabled
number_slider_130 = Slider(6, range=0..100)  # disabled
number_slider_131 = Slider(8, range=0..100)  # disabled
number_slider_132 = Slider(10, range=0..100)  # disabled
number_slider_133 = Slider(0, range=0..100)  # disabled
number_slider_134 = Slider(2, range=0..100)  # disabled
number_slider_135 = Slider(3, range=0..100)  # disabled
number_slider_136 = Slider(4, range=0..100)  # disabled
number_slider_137 = Slider(11, range=0..100)  # disabled
number_slider_138 = Slider(1, range=0..100)  # disabled
number_slider_139 = Slider(7, range=0..100)  # disabled
weight_5 = Slider(1, range=0..10)  # disabled
number_slider_140 = Slider(1, range=0..1)  # disabled
scale_8 = Scale(
    Geometry=[pt_16, pt_17, pt_18, pt_19, pt_27, pt_21, pt_20, pt_25, pt_22, pt_23, pt_24, pt_26],
    Center=pt_24,
    Factor=number_slider_140)  # -> Geometry, Transform; disabled
item_77 = ListItem(List=scale_8.Geometry, Index=number_slider_107, Wrap=True)  # disabled
item_78 = ListItem(List=scale_8.Geometry, Index=number_slider_108, Wrap=True)  # disabled
item_79 = ListItem(List=scale_8.Geometry, Index=number_slider_109, Wrap=True)  # disabled
item_80 = ListItem(List=scale_8.Geometry, Index=number_slider_110, Wrap=True)  # disabled
item_81 = ListItem(List=scale_8.Geometry, Index=number_slider_111, Wrap=True)  # disabled
item_82 = ListItem(List=scale_8.Geometry, Index=number_slider_112, Wrap=True)  # disabled
item_83 = ListItem(List=scale_8.Geometry, Index=number_slider_113, Wrap=True)  # disabled
item_84 = ListItem(List=scale_8.Geometry, Index=number_slider_114, Wrap=True)  # disabled
item_85 = ListItem(List=scale_8.Geometry, Index=number_slider_116, Wrap=True)  # disabled
item_86 = ListItem(List=scale_8.Geometry, Index=number_slider_115, Wrap=True)  # disabled
item_87 = ListItem(List=scale_8.Geometry, Index=number_slider_117, Wrap=True)  # disabled
item_88 = ListItem(List=scale_8.Geometry, Index=number_slider_118, Wrap=True)  # disabled
vec2pt_7 = Vector2Pt(PointA=item_82, PointB=item_77, Unitize=False)  # -> Vector, Length; disabled
vec2pt_8 = Vector2Pt(PointA=item_86, PointB=item_81, Unitize=False)  # -> Vector, Length; disabled
vec2pt_9 = Vector2Pt(PointA=item_85, PointB=item_84, Unitize=False)  # -> Vector, Length; disabled
vec2pt_10 = Vector2Pt(PointA=item_80, PointB=item_83, Unitize=False)  # -> Vector, Length; disabled
vec2pt_11 = Vector2Pt(PointA=item_79, PointB=item_87, Unitize=False)  # -> Vector, Length; disabled
vec2pt_12 = Vector2Pt(PointA=item_78, PointB=item_88, Unitize=False)  # -> Vector, Length; disabled
unit_7 = UnitVector(Vector=vec2pt_7.Vector)  # disabled
unit_8 = UnitVector(Vector=vec2pt_8.Vector)  # disabled
unit_9 = UnitVector(Vector=vec2pt_9.Vector)  # disabled
unit_10 = UnitVector(Vector=vec2pt_10.Vector)  # disabled
unit_11 = UnitVector(Vector=vec2pt_11.Vector)  # disabled
unit_12 = UnitVector(Vector=vec2pt_12.Vector)  # disabled
multiplication_33 = Multiplication(A=unit_7, B=vec2pt_7.Length)  # disabled
multiplication_34 = Multiplication(A=unit_8, B=vec2pt_8.Length)  # disabled
multiplication_35 = Multiplication(A=unit_10, B=vec2pt_10.Length)  # disabled
multiplication_36 = Multiplication(A=unit_11, B=vec2pt_11.Length)  # disabled
multiplication_37 = Multiplication(A=unit_12, B=vec2pt_12.Length)  # disabled
multiplication_38 = Multiplication(A=unit_9, B=vec2pt_9.Length)  # disabled
addition_16 = Addition(A=item_86, B=multiplication_34)  # disabled
addition_17 = Addition(A=item_82, B=multiplication_33)  # disabled
addition_18 = Addition(A=item_85, B=multiplication_38)  # disabled
addition_19 = Addition(A=item_80, B=multiplication_35)  # disabled
addition_20 = Addition(A=item_79, B=multiplication_36)  # disabled
addition_21 = Addition(A=item_78, B=multiplication_37)  # disabled
move_36 = Move(Geometry=item_86, Motion=Vector(0, 0, 10))  # -> Geometry, Transform; disabled
move_37 = Move(Geometry=addition_19, Motion=Vector(0, 0, 10))  # -> Geometry, Transform; disabled
move_38 = Move(Geometry=addition_16, Motion=Vector(0, 0, 10))  # -> Geometry, Transform; disabled
move_39 = Move(Geometry=item_80, Motion=Vector(0, 0, 10))  # -> Geometry, Transform; disabled
move_40 = Move(Geometry=addition_20, Motion=Vector(0, 0, 10))  # -> Geometry, Transform; disabled
move_41 = Move(Geometry=addition_21, Motion=Vector(0, 0, 10))  # -> Geometry, Transform; disabled
move_42 = Move(Geometry=item_82, Motion=Vector(0, 0, 10))  # -> Geometry, Transform; disabled
move_43 = Move(Geometry=addition_18, Motion=Vector(0, 0, 10))  # -> Geometry, Transform; disabled
move_44 = Move(Geometry=item_85, Motion=Vector(0, 0, 10))  # -> Geometry, Transform; disabled
move_45 = Move(Geometry=addition_17, Motion=Vector(0, 0, 10))  # -> Geometry, Transform; disabled
move_46 = Move(Geometry=item_78, Motion=Vector(0, 0, 10))  # -> Geometry, Transform; disabled
move_47 = Move(Geometry=item_79, Motion=Vector(0, 0, 10))  # -> Geometry, Transform; disabled

toggle_8 = BooleanToggle(True)  # disabled
pline_11 = PolyLine(Vertices=[addition_19, addition_20, addition_21], Closed=toggle_8)  # disabled
pline_12 = PolyLine(Vertices=[item_86, item_85, item_82], Closed=toggle_8)  # disabled
pline_13 = PolyLine(Vertices=[addition_18, addition_21, item_80], Closed=toggle_8)  # disabled
pline_14 = PolyLine(Vertices=[addition_17, item_86, item_79], Closed=toggle_8)  # disabled
pline_15 = PolyLine(Vertices=[addition_16, item_85, item_80], Closed=toggle_8)  # disabled
pline_16 = PolyLine(Vertices=[addition_16, addition_19, item_79], Closed=toggle_8)  # disabled
pline_17 = PolyLine(Vertices=[addition_17, addition_20, item_78], Closed=toggle_8)  # disabled
pline_18 = PolyLine(Vertices=[addition_18, item_82, item_78], Closed=toggle_8)  # disabled
area_12 = Area(Geometry=pline_12)  # -> Area, Centroid; disabled
area_13 = Area(Geometry=pline_11)  # -> Area, Centroid; disabled
area_14 = Area(Geometry=pline_13)  # -> Area, Centroid; disabled
area_15 = Area(Geometry=pline_14)  # -> Area, Centroid; disabled
area_16 = Area(Geometry=pline_15)  # -> Area, Centroid; disabled
area_17 = Area(Geometry=pline_16)  # -> Area, Centroid; disabled
area_18 = Area(Geometry=pline_17)  # -> Area, Centroid; disabled
area_19 = Area(Geometry=pline_18)  # -> Area, Centroid; disabled
move_48 = Move(Geometry=area_16.Centroid, Motion=Vector(0, 0, 10))  # -> Geometry, Transform; disabled
move_49 = Move(Geometry=area_13.Centroid, Motion=Vector(0, 0, 10))  # -> Geometry, Transform; disabled
move_50 = Move(Geometry=area_14.Centroid, Motion=Vector(0, 0, 10))  # -> Geometry, Transform; disabled
move_51 = Move(Geometry=area_12.Centroid, Motion=Vector(0, 0, 10))  # -> Geometry, Transform; disabled
move_52 = Move(Geometry=area_19.Centroid, Motion=Vector(0, 0, 10))  # -> Geometry, Transform; disabled
move_53 = Move(Geometry=area_18.Centroid, Motion=Vector(0, 0, 10))  # -> Geometry, Transform; disabled
move_54 = Move(Geometry=area_17.Centroid, Motion=Vector(0, 0, 10))  # -> Geometry, Transform; disabled
move_55 = Move(Geometry=area_15.Centroid, Motion=Vector(0, 0, 10))  # -> Geometry, Transform; disabled
ln_244 = Line(StartPoint=move_50.Geometry, EndPoint=move_41.Geometry)  # disabled
ln_245 = Line(StartPoint=move_50.Geometry, EndPoint=move_39.Geometry)  # disabled
ln_246 = Line(StartPoint=move_50.Geometry, EndPoint=move_43.Geometry)  # disabled
ln_247 = Line(StartPoint=move_49.Geometry, EndPoint=move_37.Geometry)  # disabled
ln_248 = Line(StartPoint=move_49.Geometry, EndPoint=move_40.Geometry)  # disabled
ln_249 = Line(StartPoint=move_49.Geometry, EndPoint=move_41.Geometry)  # disabled
ln_250 = Line(StartPoint=move_51.Geometry, EndPoint=move_49.Geometry)  # disabled
ln_251 = Line(StartPoint=move_55.Geometry, EndPoint=move_50.Geometry)  # disabled
ln_252 = Line(StartPoint=move_54.Geometry, EndPoint=move_38.Geometry)  # disabled
ln_253 = Line(StartPoint=move_54.Geometry, EndPoint=move_37.Geometry)  # disabled
ln_254 = Line(StartPoint=move_53.Geometry, EndPoint=move_40.Geometry)  # disabled
ln_255 = Line(StartPoint=move_54.Geometry, EndPoint=move_47.Geometry)  # disabled
ln_256 = Line(StartPoint=move_52.Geometry, EndPoint=move_54.Geometry)  # disabled
ln_257 = Line(StartPoint=move_55.Geometry, EndPoint=move_36.Geometry)  # disabled
ln_258 = Line(StartPoint=move_55.Geometry, EndPoint=move_45.Geometry)  # disabled
ln_259 = Line(StartPoint=move_53.Geometry, EndPoint=move_45.Geometry)  # disabled
ln_260 = Line(StartPoint=move_53.Geometry, EndPoint=move_46.Geometry)  # disabled
ln_261 = Line(StartPoint=move_48.Geometry, EndPoint=move_53.Geometry)  # disabled
ln_262 = Line(StartPoint=move_52.Geometry, EndPoint=move_42.Geometry)  # disabled
ln_263 = Line(StartPoint=move_52.Geometry, EndPoint=move_43.Geometry)  # disabled
ln_264 = Line(StartPoint=move_51.Geometry, EndPoint=move_36.Geometry)  # disabled
ln_265 = Line(StartPoint=move_51.Geometry, EndPoint=move_42.Geometry)  # disabled
ln_266 = Line(StartPoint=move_55.Geometry, EndPoint=move_47.Geometry)  # disabled
ln_267 = Line(StartPoint=move_48.Geometry, EndPoint=move_44.Geometry)  # disabled
ln_268 = Line(StartPoint=move_48.Geometry, EndPoint=move_39.Geometry)  # disabled
ln_269 = Line(StartPoint=move_52.Geometry, EndPoint=move_46.Geometry)  # disabled
ln_270 = Line(StartPoint=move_51.Geometry, EndPoint=move_44.Geometry)  # disabled
ln_271 = Line(StartPoint=move_48.Geometry, EndPoint=move_38.Geometry)  # disabled
merge_20 = Merge(
    Data1=ln_267,
    Data2=ln_271,
    Data3=ln_268,
    Data4=ln_262,
    Data5=ln_269,
    Data6=ln_263,
    Data7=ln_264,
    Data8=ln_270,
    Data9=ln_265,
    Data10=ln_257,
    Data11=ln_266,
    Data12=ln_258,
    Data13=ln_259,
    Data14=ln_260,
    Data15=ln_254,
    Data16=ln_255,
    Data17=ln_252,
    Data18=ln_253,
    Data19=ln_247,
    Data20=ln_248,
    Data21=ln_249,
    Data22=ln_245,
    Data23=ln_246,
    Data24=ln_244)  # disabled
merge_21 = Merge(Data1=ln_261, Data2=ln_256, Data3=ln_250, Data4=ln_251)  # disabled
merge_22 = Merge(Data1=merge_20, Data2=merge_21)  # disabled
move_56 = Move(Geometry=merge_22, Motion=Vector(0, 0, 10))  # -> Geometry, Transform; disabled

toggle_9 = BooleanToggle(True)  # disabled
pline_19 = PolyLine(Vertices=[addition_19, addition_20, addition_21], Closed=toggle_9)  # disabled
pline_20 = PolyLine(Vertices=[item_86, item_85, item_82], Closed=toggle_9)  # disabled
area_20 = Area(Geometry=pline_20)  # -> Area, Centroid; disabled
area_21 = Area(Geometry=pline_19)  # -> Area, Centroid; disabled
ln_272 = Line(StartPoint=area_21.Centroid, EndPoint=area_20.Centroid)  # disabled
midpt_2 = CurveMiddle(Curve=ln_272)  # disabled
ln_273 = Line(StartPoint=addition_20, EndPoint=midpt_2)  # disabled
ln_274 = Line(StartPoint=addition_18, EndPoint=midpt_2)  # disabled
ln_275 = Line(StartPoint=addition_19, EndPoint=midpt_2)  # disabled
ln_276 = Line(StartPoint=item_80, EndPoint=midpt_2)  # disabled
ln_277 = Line(StartPoint=item_79, EndPoint=midpt_2)  # disabled
ln_278 = Line(StartPoint=addition_17, EndPoint=midpt_2)  # disabled
ln_279 = Line(StartPoint=item_82, EndPoint=midpt_2)  # disabled
ln_280 = Line(StartPoint=item_85, EndPoint=midpt_2)  # disabled
move_57 = Move(Geometry=[ln_280, ln_279, ln_277, ln_278, ln_276, ln_275, ln_274, ln_273], Motion=Vector(0, 0, 10))  # -> Geometry, Transform; disabled
merge_23 = Merge(Data1=move_57.Geometry)  # disabled
move_58 = Move(Geometry=merge_23, Motion=Vector(0, 0, 10))  # -> Geometry, Transform; disabled

ln_281 = Line(StartPoint=move_39.Geometry, EndPoint=move_37.Geometry)  # disabled
ln_282 = Line(StartPoint=move_36.Geometry, EndPoint=move_44.Geometry)  # disabled
ln_283 = Line(StartPoint=move_42.Geometry, EndPoint=move_45.Geometry)  # disabled
ln_284 = Line(StartPoint=move_46.Geometry, EndPoint=move_41.Geometry)  # disabled
ln_285 = Line(StartPoint=move_36.Geometry, EndPoint=move_42.Geometry)  # disabled
ln_286 = Line(StartPoint=move_40.Geometry, EndPoint=move_41.Geometry)  # disabled
ln_287 = Line(StartPoint=move_44.Geometry, EndPoint=move_43.Geometry)  # disabled
ln_288 = Line(StartPoint=move_47.Geometry, EndPoint=move_40.Geometry)  # disabled
ln_289 = Line(StartPoint=move_36.Geometry, EndPoint=move_47.Geometry)  # disabled
ln_290 = Line(StartPoint=move_36.Geometry, EndPoint=move_45.Geometry)  # disabled
ln_291 = Line(StartPoint=move_38.Geometry, EndPoint=move_37.Geometry)  # disabled
ln_292 = Line(StartPoint=move_37.Geometry, EndPoint=move_40.Geometry)  # disabled
ln_293 = Line(StartPoint=move_43.Geometry, EndPoint=move_41.Geometry)  # disabled
ln_294 = Line(StartPoint=move_36.Geometry, EndPoint=move_38.Geometry)  # disabled
ln_295 = Line(StartPoint=move_44.Geometry, EndPoint=move_42.Geometry)  # disabled
ln_296 = Line(StartPoint=move_45.Geometry, EndPoint=move_46.Geometry)  # disabled
ln_297 = Line(StartPoint=move_38.Geometry, EndPoint=move_39.Geometry)  # disabled
ln_298 = Line(StartPoint=move_39.Geometry, EndPoint=move_43.Geometry)  # disabled
ln_299 = Line(StartPoint=move_37.Geometry, EndPoint=move_40.Geometry)  # disabled
ln_300 = Line(StartPoint=move_44.Geometry, EndPoint=move_38.Geometry)  # disabled
ln_301 = Line(StartPoint=move_42.Geometry, EndPoint=move_46.Geometry)  # disabled
ln_302 = Line(StartPoint=move_47.Geometry, EndPoint=move_37.Geometry)  # disabled
ln_303 = Line(StartPoint=move_45.Geometry, EndPoint=move_40.Geometry)  # disabled
ln_304 = Line(StartPoint=move_46.Geometry, EndPoint=move_40.Geometry)  # disabled
ln_305 = Line(StartPoint=move_39.Geometry, EndPoint=move_41.Geometry)  # disabled
ln_306 = Line(StartPoint=move_44.Geometry, EndPoint=move_39.Geometry)  # disabled
ln_307 = Line(StartPoint=move_42.Geometry, EndPoint=move_43.Geometry)  # disabled
ln_308 = Line(StartPoint=move_47.Geometry, EndPoint=move_38.Geometry)  # disabled
ln_309 = Line(StartPoint=move_46.Geometry, EndPoint=move_43.Geometry)  # disabled
ln_310 = Line(StartPoint=move_47.Geometry, EndPoint=move_45.Geometry)  # disabled
merge_24 = Merge(
    Data1=ln_282,
    Data2=ln_285,
    Data3=ln_289,
    Data4=ln_290,
    Data5=ln_295,
    Data6=ln_300,
    Data7=ln_306,
    Data8=ln_301,
    Data9=ln_307,
    Data10=ln_310,
    Data11=ln_308,
    Data12=ln_302,
    Data13=ln_296,
    Data14=ln_303,
    Data15=ln_309,
    Data16=ln_304,
    Data17=ln_297,
    Data18=ln_291,
    Data19=ln_298,
    Data20=ln_305,
    Data21=ln_299,
    Data22=ln_292,
    Data23=ln_293,
    Data24=ln_286)  # disabled
merge_25 = Merge(Data1=ln_294, Data2=ln_287, Data3=ln_283, Data4=ln_288, Data5=ln_284, Data6=ln_281)  # disabled
move_59 = Move(Geometry=merge_24, Motion=Vector(0, 0, 10))  # -> Geometry, Transform; disabled
move_60 = Move(Geometry=merge_25, Motion=Vector(0, 0, 10))  # -> Geometry, Transform; disabled
pipe_6 = Pipe(Curve=move_60.Geometry, Radius=number_slider_120, Caps=0)  # disabled
geo_97 = Geometry(pipe_6)  # disabled
string_11 = Geometry(move_59.Geometry)  # disabled
struts_11 = Geometry(move_60.Geometry)  # disabled
geo_98 = Geometry(move_56.Geometry)  # disabled
len_19 = Length(Curve=struts_11)  # disabled
avr_19 = Average(Input=len_19)  # disabled
move_61 = Move(Geometry=[string_11, geo_98], Motion=Z_7)  # -> Geometry, Transform; disabled
move_62 = Move(Geometry=struts_11, Motion=Z_7)  # -> Geometry, Transform; disabled
multiplication_39 = Multiplication(A=_2_5, B=pi_8, C=number_slider_120, D=avr_19, E=number_slider_121)  # disabled
split_3 = SplitList(List=move_61.Geometry, Index=number_slider_123)  # -> ListA, ListB; disabled
geo_99 = Geometry(split_3.ListB)  # disabled
ct_5 = ConstantTension(Line=move_61.Geometry, Strength=1)  # disabled
length_line_5 = LengthLine(Line=move_61.Geometry, Length=move_61.Geometry, Strength=k_5)  # disabled
length_line_6 = LengthLine(Line=move_62.Geometry, Strength=number_slider_119)  # disabled
panel_36 = Panel(ct_5)  # disabled
button_6 = Button()  # disabled
toggle_10 = BooleanToggle(False)  # disabled
loop_start_6 = LoopStart(Repeat=loop_index_6, Trigger=toggle_10, Data=initial_velocity_5)  # -> port, Counter, Data; disabled
addition_22 = Addition(A=loop_start_6.Data, B=division_14)  # disabled
loop_end_6 = LoopEnd(port=loop_start_6.port, Exit=False, Data=addition_22, TimeOutVal=0, pausedState=False, state="Constant output")  # disabled
pow_5 = Power(A=loop_end_6, B=number_slider_125)  # disabled
multiplication_40 = Multiplication(A=number_slider_122, B=air_density_kg_m3_5, C=c_d_5, D=pow_5, E=multiplication_39)  # disabled
division_15 = Division(A=multiplication_40, B=scale_7)  # disabled
multiplication_41 = Multiplication(A=pow_5, B=weight_5, C=number_slider_126)  # disabled
addition_23 = Addition(A=multiplication_41, B=division_15)  # disabled
dw_5 = DynamicWeight1d(Line=move_62.Geometry, Weight=addition_23)  # disabled
bouncysolver_6 = BouncySolver(
    GoalObjects=[length_line_5, floor_6, dw_5, length_line_6],
    Reset=button_6,
    Threshold=1e-15,
    Tolerance=0.0001,
    Damping=0.99,
    Iterations=10,
    On=toggle_10)  # -> I, V, O; disabled
geo_100 = Geometry(bouncysolver_6.V)  # disabled
panel_37 = Panel(geo_100)  # disabled
split_4 = SplitList(List=geo_100, Index=number_slider_127)  # -> ListA, ListB; disabled
panel_38 = Panel(split_4.ListB)  # disabled
duppt = RemoveDuplicatePts(Points=split_4.ListA, Tolerance=0.01)  # disabled
toggle_11 = BooleanToggle(False)  # disabled
item_89 = ListItem(List=duppt, Index=number_slider_128, Wrap=True)  # disabled
item_90 = ListItem(List=duppt, Index=number_slider_132, Wrap=True)  # disabled
item_91 = ListItem(List=duppt, Index=number_slider_137, Wrap=True)  # disabled
item_92 = ListItem(List=duppt, Index=number_slider_129, Wrap=True)  # disabled
item_93 = ListItem(List=duppt, Index=number_slider_130, Wrap=True)  # disabled
item_94 = ListItem(List=duppt, Index=number_slider_131, Wrap=True)  # disabled
item_95 = ListItem(List=duppt, Index=number_slider_134, Wrap=True)  # disabled
item_96 = ListItem(List=duppt, Index=number_slider_136, Wrap=True)  # disabled
item_97 = ListItem(List=duppt, Index=number_slider_139, Wrap=True)  # disabled
item_98 = ListItem(List=duppt, Index=number_slider_133, Wrap=True)  # disabled
item_99 = ListItem(List=duppt, Index=number_slider_138, Wrap=True)  # disabled
item_100 = ListItem(List=duppt, Index=number_slider_135, Wrap=True)  # disabled
number_slider_141 = Slider(0.5, range=0..10)  # disabled
panel_39 = Panel(duppt)  # disabled
pt_28 = Point(item_92)  # disabled
pt_29 = Point(item_98)  # disabled
pt_30 = Point(item_93)  # disabled
pt_31 = Point(item_89)  # disabled
pt_32 = Point(item_94)  # disabled
pt_33 = Point(item_99)  # disabled
pt_34 = Point(item_95)  # disabled
pt_35 = Point(item_100)  # disabled
pt_36 = Point(item_90)  # disabled
pt_37 = Point(item_91)  # disabled
pt_38 = Point(item_96)  # disabled

duppt_2 = RemoveDuplicatePts(Points=split_4.ListB, Tolerance=0.01)  # disabled
pt_39 = Point(duppt_2)  # disabled
panel_40 = Panel(duppt_2)  # disabled
ln_311 = Line(StartPoint=pt_36, EndPoint=pt_39)  # disabled
ln_312 = Line(StartPoint=pt_32, EndPoint=pt_39)  # disabled
ln_313 = Line(StartPoint=pt_31, EndPoint=pt_39)  # disabled
ln_314 = Line(StartPoint=pt_30, EndPoint=pt_39)  # disabled
ln_315 = Line(StartPoint=pt_35, EndPoint=pt_39)  # disabled
ln_316 = Line(StartPoint=pt_38, EndPoint=pt_39)  # disabled
ln_317 = Line(StartPoint=pt_34, EndPoint=pt_39)  # disabled
ln_318 = Line(StartPoint=pt_33, EndPoint=pt_39)  # disabled
merge_26 = Merge(Data1=ln_318, Data2=ln_317, Data3=ln_315, Data4=ln_316, Data5=ln_314, Data6=ln_313, Data7=ln_312, Data8=ln_311)  # disabled

pt_40 = Point(pt_39)  # disabled
pt_41 = Point(item_97)  # disabled

number_slider_142 = Slider(0, range=0..100)  # disabled
duppt_3 = RemoveDuplicatePts(Points=split_4.ListB, Tolerance=0.01)  # disabled
split_5 = SplitList(List=duppt_3, Index=number_slider_142)  # -> ListA, ListB; disabled
number_slider_143 = Slider(6, range=0..100)  # disabled
number_slider_144 = Slider(7, range=0..100)  # disabled
number_slider_145 = Slider(0, range=0..100)  # disabled
number_slider_146 = Slider(1, range=0..100)  # disabled
number_slider_147 = Slider(2, range=0..100)  # disabled
number_slider_148 = Slider(3, range=0..100)  # disabled
number_slider_149 = Slider(4, range=0..100)  # disabled
number_slider_150 = Slider(5, range=0..100)  # disabled
item_101 = ListItem(List=split_5.ListB, Index=number_slider_143, Wrap=True)  # disabled
item_102 = ListItem(List=split_5.ListB, Index=number_slider_144, Wrap=True)  # disabled
item_103 = ListItem(List=split_5.ListB, Index=number_slider_147, Wrap=True)  # disabled
item_104 = ListItem(List=split_5.ListB, Index=number_slider_149, Wrap=True)  # disabled
item_105 = ListItem(List=split_5.ListB, Index=number_slider_150, Wrap=True)  # disabled
item_106 = ListItem(List=split_5.ListB, Index=number_slider_145, Wrap=True)  # disabled
item_107 = ListItem(List=split_5.ListB, Index=number_slider_146, Wrap=True)  # disabled
item_108 = ListItem(List=split_5.ListB, Index=number_slider_148, Wrap=True)  # disabled
pt_42 = Point(item_101)  # disabled
pt_43 = Point(item_106)  # disabled
pt_44 = Point(item_102)  # disabled
pt_45 = Point(item_107)  # disabled
pt_46 = Point(item_103)  # disabled
pt_47 = Point(item_108)  # disabled
pt_48 = Point(item_104)  # disabled
pt_49 = Point(item_105)  # disabled
ln_319 = Line(StartPoint=pt_44, EndPoint=pt_37)  # disabled
ln_320 = Line(StartPoint=pt_44, EndPoint=pt_30)  # disabled
ln_321 = Line(StartPoint=pt_44, EndPoint=pt_32)  # disabled
ln_322 = Line(StartPoint=pt_42, EndPoint=pt_31)  # disabled
ln_323 = Line(StartPoint=pt_42, EndPoint=pt_36)  # disabled
ln_324 = Line(StartPoint=pt_42, EndPoint=pt_37)  # disabled
ln_325 = Line(StartPoint=pt_46, EndPoint=pt_42)  # disabled
ln_326 = Line(StartPoint=pt_47, EndPoint=pt_44)  # disabled
ln_327 = Line(StartPoint=pt_49, EndPoint=pt_28)  # disabled
ln_328 = Line(StartPoint=pt_49, EndPoint=pt_31)  # disabled
ln_329 = Line(StartPoint=pt_48, EndPoint=pt_36)  # disabled
ln_330 = Line(StartPoint=pt_49, EndPoint=pt_35)  # disabled
ln_331 = Line(StartPoint=pt_45, EndPoint=pt_49)  # disabled
ln_332 = Line(StartPoint=pt_47, EndPoint=pt_29)  # disabled
ln_333 = Line(StartPoint=pt_47, EndPoint=pt_38)  # disabled
ln_334 = Line(StartPoint=pt_48, EndPoint=pt_38)  # disabled
ln_335 = Line(StartPoint=pt_48, EndPoint=pt_41)  # disabled
ln_336 = Line(StartPoint=pt_43, EndPoint=pt_48)  # disabled
ln_337 = Line(StartPoint=pt_45, EndPoint=pt_34)  # disabled
ln_338 = Line(StartPoint=pt_45, EndPoint=pt_32)  # disabled
ln_339 = Line(StartPoint=pt_46, EndPoint=pt_29)  # disabled
ln_340 = Line(StartPoint=pt_46, EndPoint=pt_34)  # disabled
ln_341 = Line(StartPoint=pt_47, EndPoint=pt_35)  # disabled
ln_342 = Line(StartPoint=pt_43, EndPoint=pt_33)  # disabled
ln_343 = Line(StartPoint=pt_43, EndPoint=pt_30)  # disabled
ln_344 = Line(StartPoint=pt_45, EndPoint=pt_41)  # disabled
ln_345 = Line(StartPoint=pt_46, EndPoint=pt_33)  # disabled
ln_346 = Line(StartPoint=pt_43, EndPoint=pt_28)  # disabled
midpt_3 = CurveMiddle(Curve=ln_336)  # disabled
midpt_4 = CurveMiddle(Curve=ln_331)  # disabled
midpt_5 = CurveMiddle(Curve=ln_325)  # disabled
midpt_6 = CurveMiddle(Curve=ln_326)  # disabled
merge_27 = Merge(
    Data1=ln_342,
    Data2=ln_346,
    Data3=ln_343,
    Data4=ln_337,
    Data5=ln_344,
    Data6=ln_338,
    Data7=ln_339,
    Data8=ln_345,
    Data9=ln_340,
    Data10=ln_332,
    Data11=ln_341,
    Data12=ln_333,
    Data13=ln_334,
    Data14=ln_335,
    Data15=ln_329,
    Data16=ln_330,
    Data17=ln_327,
    Data18=ln_328,
    Data19=ln_322,
    Data20=ln_323,
    Data21=ln_324,
    Data22=ln_320,
    Data23=ln_321,
    Data24=ln_319)  # disabled
merge_28 = Merge(Data1=ln_336, Data2=ln_331, Data3=ln_325, Data4=ln_326)  # disabled
merge_29 = Merge(Data1=merge_27, Data2=merge_28)  # disabled

avr_20 = Average(Input=[midpt_3, midpt_4, midpt_5, midpt_6])  # disabled
pt_50 = Point(avr_20)  # disabled
py3 = Python3Script(x=pt_29, y=toggle_11)  # -> out, a; disabled
# ---------- py3: Python ----------
"""Grasshopper Script"""

import Rhino.Geometry as rg
import scriptcontext as sc
import Rhino
import csv
import os

def compute_velocity(prev_pos, current_pos):
    return current_pos - prev_pos

def compute_acceleration(prev_vel, current_vel):
    return current_vel - prev_vel


if "positions_up" not in sc.sticky or y:
    sc.sticky["positions_up"] = []

if "prev_pos" not in sc.sticky or y:
    sc.sticky["prev_pos"] = rg.Point3d.Unset
    sc.sticky["prev_vel"] = rg.Vector3d.Zero

if not y:
    obj = sc.doc.Objects.Find(x)
    current_pos = obj.Geometry.Location

    # Calculate velocity
    current_vel = compute_velocity(sc.sticky["prev_pos"], current_pos)

    # Calculate acceleration
    acceleration = compute_acceleration(sc.sticky["prev_vel"], current_vel)

    # Store the current position
    sc.sticky["positions_up"].append(current_pos)

    # Store current states for next iteration
    sc.sticky["prev_pos"] = current_pos
    sc.sticky["prev_vel"] = current_vel

# Path to save the CSV file (adjust path as needed)
file_path = os.path.join("/Users/julia/Desktop/Cornell2025Spring/studio/data", "positions_up_out_high.csv")

# Write positions_up to a CSV file
with open(file_path, 'w', newline='') as file:
    writer = csv.writer(file)
    writer.writerow(['X', 'Y', 'Z'])  # Writing headers if needed
    for pos in sc.sticky["positions_up"]:
        if isinstance(pos, rg.Point3d):
            writer.writerow([pos.X, pos.Y, pos.Z])

# Output the acceleration
a = acceleration
# ---------- end py3 ----------
py3_2 = Python3Script(x=pt_50, y=toggle_11)  # -> out, a; disabled
# ---------- py3_2: Python ----------
"""Grasshopper Script"""

import Rhino.Geometry as rg
import scriptcontext as sc
import Rhino
import csv
import os

def compute_velocity(prev_pos, current_pos):
    return current_pos - prev_pos

def compute_acceleration(prev_vel, current_vel):
    return current_vel - prev_vel


if "positions_payload" not in sc.sticky or y:
    sc.sticky["positions_payload"] = []

if "prev_pos" not in sc.sticky or y:
    sc.sticky["prev_pos"] = rg.Point3d.Unset
    sc.sticky["prev_vel"] = rg.Vector3d.Zero

if not y:
    obj = sc.doc.Objects.Find(x)
    current_pos = obj.Geometry.Location

    # Calculate velocity
    current_vel = compute_velocity(sc.sticky["prev_pos"], current_pos)

    # Calculate acceleration
    acceleration = compute_acceleration(sc.sticky["prev_vel"], current_vel)

    # Store the current position
    sc.sticky["positions_payload"].append(current_pos)

    # Store current states for next iteration
    sc.sticky["prev_pos"] = current_pos
    sc.sticky["prev_vel"] = current_vel

# Path to save the CSV file (adjust path as needed)
file_path = os.path.join("/Users/julia/Desktop/Cornell2025Spring/studio/data", "positions_payload_out_high.csv")

# Write positions_payload to a CSV file
with open(file_path, 'w', newline='') as file:
    writer = csv.writer(file)
    writer.writerow(['X', 'Y', 'Z'])  # Writing headers if needed
    for pos in sc.sticky["positions_payload"]:
        if isinstance(pos, rg.Point3d):
            writer.writerow([pos.X, pos.Y, pos.Z])

# Output the acceleration
a = acceleration
# ---------- end py3_2 ----------
py3_3 = Python3Script(x=pt_29, y=pt_37, z=pt_50, u=toggle_11)  # -> out, a; disabled
# ---------- py3_3: Python ----------
import Rhino.Geometry as rg
import scriptcontext as sc
import Rhino
import csv
import os

# Initialize or reset lists based on 'u'
if u:
    sc.sticky["positions_up"] = []
    sc.sticky["positions_down"] = []
    sc.sticky["positions_payload"] = []

else:
    # Find objects and get locations
    obj = sc.doc.Objects.Find(x)
    current_pos1 = obj.Geometry.Location if obj else rg.Point3d.Unset

    obj = sc.doc.Objects.Find(y)
    current_pos2 = obj.Geometry.Location if obj else rg.Point3d.Unset

    obj = sc.doc.Objects.Find(z)
    current_pos3 = obj.Geometry.Location if obj else rg.Point3d.Unset

    # Append positions to lists if they are valid Point3d objects
    if isinstance(current_pos1, rg.Point3d):
        sc.sticky["positions_up"].append(current_pos1)
    if isinstance(current_pos2, rg.Point3d):
        sc.sticky["positions_down"].append(current_pos2)
    if isinstance(current_pos3, rg.Point3d):
        sc.sticky["positions_payload"].append(current_pos3)

    # Specify the path for the CSV file
    file_path = os.path.join("/Users/julia/Desktop/Cornell2025Spring/studio/data", "positions.csv")

    # Write positions to a CSV file
    with open(file_path, 'w', newline='') as file:
        writer = csv.writer(file)
        writer.writerow(['X1', 'Y1', 'Z1', 'X2', 'Y2', 'Z2', 'X3', 'Y3', 'Z3'])  # Column headers for clarity

        # Zip lists and write rows
        for pos1, pos2, pos3 in zip(sc.sticky["positions_up"], sc.sticky["positions_down"], sc.sticky["positions_payload"]):
            writer.writerow([pos1.X, pos1.Y, pos1.Z, pos2.X, pos2.Y, pos2.Z, pos3.X, pos3.Y, pos3.Z])

# Output lists
a = (sc.sticky["positions_up"], sc.sticky["positions_down"], sc.sticky["positions_payload"])
# ---------- end py3_3 ----------
py3_4 = Python3Script(x=pt_37, y=toggle_11)  # -> out, a; disabled
# ---------- py3_4: Python ----------
"""Grasshopper Script"""

import Rhino.Geometry as rg
import scriptcontext as sc
import Rhino
import csv
import os

def compute_velocity(prev_pos, current_pos):
    return current_pos - prev_pos

def compute_acceleration(prev_vel, current_vel):
    return current_vel - prev_vel


if "positions_down" not in sc.sticky or y:
    sc.sticky["positions_down"] = []

if "prev_pos" not in sc.sticky or y:
    sc.sticky["prev_pos"] = rg.Point3d.Unset
    sc.sticky["prev_vel"] = rg.Vector3d.Zero

if not y:
    obj = sc.doc.Objects.Find(x)
    current_pos = obj.Geometry.Location

    # Calculate velocity
    current_vel = compute_velocity(sc.sticky["prev_pos"], current_pos)

    # Calculate acceleration
    acceleration = compute_acceleration(sc.sticky["prev_vel"], current_vel)

    # Store the current position
    sc.sticky["positions_down"].append(current_pos)

    # Store current states for next iteration
    sc.sticky["prev_pos"] = current_pos
    sc.sticky["prev_vel"] = current_vel

# Path to save the CSV file (adjust path as needed)
file_path = os.path.join("/Users/julia/Desktop/Cornell2025Spring/studio/data", "positions_down_out_high.csv")

# Write positions_down to a CSV file
with open(file_path, 'w', newline='') as file:
    writer = csv.writer(file)
    writer.writerow(['X', 'Y', 'Z'])  # Writing headers if needed
    for pos in sc.sticky["positions_down"]:
        if isinstance(pos, rg.Point3d):
            writer.writerow([pos.X, pos.Y, pos.Z])

# Output the acceleration
a = acceleration
# ---------- end py3_4 ----------
box = CenterBox(Base=pt_50, X=number_slider_141, Y=number_slider_141, Z=number_slider_141)  # disabled
panel_41 = Panel(py3_3.a)  # disabled
panel_42 = Panel(py3.a)  # disabled
panel_43 = Panel(py3_2.a)  # disabled
panel_44 = Panel(py3_4.a)  # disabled
division_16 = Division(A=loop_end_6, B=weight_5)  # disabled
velocity_5 = Panel(division_16)  # disabled
ke_fg_5 = Panel(multiplication_41)  # disabled
air_resistance_5 = Panel(division_15)  # disabled
ln_347 = Line(StartPoint=pt_30, EndPoint=pt_31)  # disabled
ln_348 = Line(StartPoint=pt_29, EndPoint=pt_33)  # disabled
ln_349 = Line(StartPoint=pt_34, EndPoint=pt_38)  # disabled
ln_350 = Line(StartPoint=pt_41, EndPoint=pt_37)  # disabled
ln_351 = Line(StartPoint=pt_29, EndPoint=pt_34)  # disabled
ln_352 = Line(StartPoint=pt_36, EndPoint=pt_37)  # disabled
ln_353 = Line(StartPoint=pt_33, EndPoint=pt_32)  # disabled
ln_354 = Line(StartPoint=pt_35, EndPoint=pt_36)  # disabled
ln_355 = Line(StartPoint=pt_29, EndPoint=pt_35)  # disabled
ln_356 = Line(StartPoint=pt_29, EndPoint=pt_38)  # disabled
ln_357 = Line(StartPoint=pt_28, EndPoint=pt_31)  # disabled
ln_358 = Line(StartPoint=pt_31, EndPoint=pt_36)  # disabled
ln_359 = Line(StartPoint=pt_32, EndPoint=pt_37)  # disabled
ln_360 = Line(StartPoint=pt_29, EndPoint=pt_28)  # disabled
ln_361 = Line(StartPoint=pt_33, EndPoint=pt_34)  # disabled
ln_362 = Line(StartPoint=pt_38, EndPoint=pt_41)  # disabled
ln_363 = Line(StartPoint=pt_28, EndPoint=pt_30)  # disabled
ln_364 = Line(StartPoint=pt_30, EndPoint=pt_32)  # disabled
ln_365 = Line(StartPoint=pt_31, EndPoint=pt_36)  # disabled
ln_366 = Line(StartPoint=pt_33, EndPoint=pt_28)  # disabled
ln_367 = Line(StartPoint=pt_34, EndPoint=pt_41)  # disabled
ln_368 = Line(StartPoint=pt_35, EndPoint=pt_31)  # disabled
ln_369 = Line(StartPoint=pt_38, EndPoint=pt_36)  # disabled
ln_370 = Line(StartPoint=pt_41, EndPoint=pt_36)  # disabled
ln_371 = Line(StartPoint=pt_30, EndPoint=pt_37)  # disabled
ln_372 = Line(StartPoint=pt_33, EndPoint=pt_30)  # disabled
ln_373 = Line(StartPoint=pt_34, EndPoint=pt_32)  # disabled
ln_374 = Line(StartPoint=pt_35, EndPoint=pt_28)  # disabled
ln_375 = Line(StartPoint=pt_41, EndPoint=pt_32)  # disabled
ln_376 = Line(StartPoint=pt_35, EndPoint=pt_38)  # disabled
merge_30 = Merge(
    Data1=ln_348,
    Data2=ln_351,
    Data3=ln_355,
    Data4=ln_356,
    Data5=ln_361,
    Data6=ln_366,
    Data7=ln_372,
    Data8=ln_367,
    Data9=ln_373,
    Data10=ln_376,
    Data11=ln_374,
    Data12=ln_368,
    Data13=ln_362,
    Data14=ln_369,
    Data15=ln_375,
    Data16=ln_370,
    Data17=ln_363,
    Data18=ln_357,
    Data19=ln_364,
    Data20=ln_371,
    Data21=ln_365,
    Data22=ln_358,
    Data23=ln_359,
    Data24=ln_352)  # disabled
merge_31 = Merge(Data1=ln_360, Data2=ln_353, Data3=ln_349, Data4=ln_354, Data5=ln_350, Data6=ln_347)  # disabled
geo_101 = Geometry(merge_30)  # disabled
pipe_7 = Pipe(Curve=merge_31, Radius=number_slider_120, Caps=0)  # disabled
geo_102 = Geometry(pipe_7)  # disabled
pt_51 = Point(Point(52.81789703, -1.448079771, 11.7788585))
pt_52 = Point(Point(56.56789835, 5.047111576, 11.77886421))
pt_53 = Point(Point(60.3178948, -1.448076688, 11.77886056))
pt_54 = Point(Point(50.50027115, 4.220134429, 7.448733589))
pt_55 = Point(Point(56.56789703, 7.723280664, 4.772571352))
pt_56 = Point(Point(56.56788914, -6.289301761, 7.448733839))
pt_57 = Point(Point(52.81789508, 2.882059844, 0.4424575919))
pt_58 = Point(Point(62.6355207, -2.78616056, 4.772565587))
pt_59 = Point(Point(56.56788932, -3.613134818, 0.4424416316))
pt_60 = Point(Point(62.63552506, 4.220132368, 7.448735164))
pt_61 = Point(Point(60.31789508, 2.882052385, 0.4424416316))
pt_62 = Point(Point(50.50027303, -2.786153621, 4.772585958))
relay = Relay()
pi_9 = Pi(Factor=1)
pi_10 = Pi(Factor=1)
pi_11 = Pi(Factor=1)
relay_2 = Relay()
multiplication_42 = Multiplication(A=Slider(0, range=0..1), B=pi_9)
pt_63 = Point(Point(56.56789494, 0.7169887546, 6.11065402))
multiplication_43 = Multiplication(A=Slider(0, range=0..1), B=pi_10)
multiplication_44 = Multiplication(A=Slider(0, range=0..1), B=pi_11)
scale_9 = Scale(
    Geometry=[pt_51, pt_52, pt_53, pt_54, pt_62, pt_56, pt_55, pt_60, pt_57, pt_58, pt_59, pt_61],
    Center=pt_59,
    Factor=relay_2)  # -> Geometry, Transform
X_2 = UnitX(Factor=1)
Y_3 = UnitY(Factor=1)
rot3d_4 = Rotate3D(Geometry=scale_9.Geometry, Angle=multiplication_42, Center=pt_63, Axis=X_2)  # -> Geometry, Transform
rot3d_5 = Rotate3D(Geometry=rot3d_4.Geometry, Angle=multiplication_43, Center=pt_63, Axis=Y_3)  # -> Geometry, Transform
rot3d_6 = Rotate3D(Geometry=rot3d_5.Geometry, Angle=multiplication_44, Center=pt_63, Axis=Vector(0, 0, 1))  # -> Geometry, Transform
panel_45 = Panel(rot3d_6.Geometry)
item_109 = ListItem(List=rot3d_6.Geometry, Index=Slider(4, range=0..100), Wrap=True)
item_110 = ListItem(List=rot3d_6.Geometry, Index=Slider(5, range=0..100), Wrap=True)
item_111 = ListItem(List=rot3d_6.Geometry, Index=Slider(3, range=0..100), Wrap=True)
item_112 = ListItem(List=rot3d_6.Geometry, Index=Slider(7, range=0..100), Wrap=True)
item_113 = ListItem(List=rot3d_6.Geometry, Index=Slider(6, range=0..100), Wrap=True)
item_114 = ListItem(List=rot3d_6.Geometry, Index=Slider(2, range=0..100), Wrap=True)
item_115 = ListItem(List=rot3d_6.Geometry, Index=Slider(8, range=0..100), Wrap=True)
item_116 = ListItem(List=rot3d_6.Geometry, Index=Slider(9, range=0..100), Wrap=True)
item_117 = ListItem(List=rot3d_6.Geometry, Index=Slider(1, range=0..100), Wrap=True)
item_118 = ListItem(List=rot3d_6.Geometry, Index=Slider(0, range=0..100), Wrap=True)
item_119 = ListItem(List=rot3d_6.Geometry, Index=Slider(10, range=0..100), Wrap=True)
item_120 = ListItem(List=rot3d_6.Geometry, Index=Slider(11, range=0..100), Wrap=True)
